vi "802.11 Configure Dynamic Parameters.gvi"   [LabVIEW Communications System Design Suite 2.0.1]
# Configures all parameters that can be modified when the station is active.
# See also: 802.11 Configure Static Parameters.gvi
inputs:
  "FPGA interface": "802.11 FGPA Reference.gtype"  # Interface to the device's FPGA handle.
  "error in": error
  "format": enum{"a", "ac"} = "a"  # The 802.11 format to use (currently a or ac). Default: a
  "transmit ACK": bool  # Switches to enabled/disabled ACK transmission. Default: True
  "CCA energy detection threshold": FXP(10.3) = -72  # Threshold for the CCA energy detection busy flag. Default: -72
outputs:
  "error out": error
diagram:
  Is Equal(x=$format, y="a") -> w1
  Not(x=$"transmit ACK") -> w2
  Property Node(instance in=$"FPGA interface", "format"=$format, "DC centered signal"=w1, "suppress ACK"=w2, error in=$"error in") -> (error out=w3)
  Property Node(instance in=$"FPGA interface", "CCA energy detect threshold"=$"CCA energy detection threshold", error in=$"error in") -> (error out=w4)
  Merge Errors(w3, w4) -> (error out=w5)
  $"error out" <- w5
