vi "802.11 Host Init.gvi"   [LabVIEW Communications System Design Suite 2.0.1]
inputs:
  "device": string = "RIO0"  # RIO name of the target device. Default: RIO0
  "error in": error
  "reference clock": string = "Internal"  # Reference Clock source.
  "USRP bandwidth": "USRP bandwidth.gtype" = "40 MHz"  # Device bandwidth of USRP. This parameter is used to select the correct bitfile image for the USRP device. It can be ignored for FlexRIO-FAM modules.
outputs:
  "session out": "802.11 Host Session.gtype"
    # Cluster containing all references the host uses during runtime. This cluster includes the following components:
    # FPGA interface: empty reference to the FPGA handle; needs to be cast each time it is used.
    # FlexRIO session: handle to the FlexRIO device. This component is valid only with FlexRIO devices.
    # FlexRIO TX Characterization Data: This component is valid only with FlexRIO sessions.
    # FlexRIO RX Characterization Data: This component is valid only with FlexRIO sessions.
    # USRP session: handle to the USRP device, including charaterization data. This component is valid only with USRP.
    # stop queue: handle to queue used to coordinate host shutdown between the loops.
    # send queue: handle to queue used to buffer TX packets to the target.
    # receive queue: handle to queue used to buffer RX packets from the target.
    # receive throughput queue: handle to queue used to buffer information about received RX packets (time and transferred bytes).
    # UDP receiver: handle to a UPD socket used to receive payload from outside the host.
    # PN packet: byte array used to stream payload inside the host.
  "custom session out": "Custom session.gtype"
  "error out": error
types:
  T1 = cluster{"Timestamp": u32, "Transferred Bytes": u32}
  T2 = cluster{"fpga ref": any, "bus instance": u32, "instruction FIFO depth": u32, "executing on FPGA target": bool, "show error call chain": bool}
  T3 = cluster{"Actual Gain [dB]": f64, "Attenuation Table Index": i32}
  T4 = cluster{"Attenuation Table [dB]": f64[][], "Frequencies [Hz]": f64[], "IQ Imbalance Table": "niUsrpRio Config v1 Host.lvlib__IQ Imbalance.gtype"[], "Gain Table": T3[][]}
  "niInstr Register Bus v0 Host.lvlib__Register Bus Session.gtype" = Queue<"niInstr Register Bus v0 Host.lvlib__Session Data.gtype">
  "Semaphore RefNum.gtype" = i32
  "niUsrpRio Config v1 Host.lvlib__DB Queue Reference.gtype" = Queue<"niUsrpRio Config v1 Host.lvlib__Daughterboard Data.gtype">
  "niUsrpRio Config v1 Host.lvlib__niUsrpRio Session.gtype" = cluster{"FPGA Interface": any, "RIO Interface Number": u32, "Data Clock Rate": u32, "FPGA Data Clock Rate": u32, "Global Settings Register Bus": "niInstr Register Bus v0 Host.lvlib__Register Bus Session.gtype", "Radio 0 Settings Register Bus": "niInstr Register Bus v0 Host.lvlib__Register Bus Session.gtype", "Radio 1 Settings Register Bus": "niInstr Register Bus v0 Host.lvlib__Register Bus Session.gtype", "Radio Settings Bus Semaphore": "Semaphore RefNum.gtype", "DB Queues": "niUsrpRio Config v1 Host.lvlib__DB Queue Reference.gtype"[], "Characterization Data Valid?": bool, "EEPROM Header": "niUsrpRio Config v1 Host.lvlib__EEPROM Header.gtype", "Device Data Header": "niUsrpRio Config v1 Host.lvlib__EEPROM Device Data Header.gtype", "EEPROM Characterization Header": "niUsrpRio Config v1 Host.lvlib__EEPROM Characterization Header.gtype", "Characterization Data": "niUsrpRio Config v1 Host.lvlib__Characterization Data.gtype"[], "FPGA Current Version": u32, "FPGA Oldest Compatible Version": u32, "Fixed Logic Current Version": u32, "Fixed Logic Oldest Compatible Version": u32, "FPGA Radio Settings Bus Current Version": u32, "FPGA Radio Settings Bus Oldest Compatible Version": u32, "FPGA Board Config Current Version": u32, "FPGA Board Config Oldest Compatible Version": u32, "Daughterboard Clock Rate": u32}
  T5 = cluster{"Timestamp": u32, "Transferred Bytes": u32, "Flow ID": u8}
  "802.11 Host Session.gtype" = cluster{"FPGA interface": "802.11 FGPA Reference.gtype", "send queue": Queue<u8[]>, "receive queue": Queue<u8[]>, "receive throughput queue": Queue<T1>, "UDP Receiver": UdpNetworkConnectionRefnum, "PN packet": u8[], "FlexRIO session": Queue<T2>, "FlexRIO TX Characterization Data": T4, "FlexRIO RX Characterization Data": T4, "USRP session": "niUsrpRio Config v1 Host.lvlib__niUsrpRio Session.gtype", "RF loop clock frequency": f64, "queue out": Queue<T5>}
  "USRP bandwidth.gtype" = enum{"40 MHz", "120 MHz", "160 MHz"}
  T6 = cluster{"Timestamp": u32, "Timing Control State Enum": u32}
  T7 = cluster{"Timestamp": u32, "LSB of MAC Address": u16, "MSB of MAC Address": u16}
  "Custom session.gtype" = cluster{"H2T TX Data FIFO: actual depth": u32, "Track CCA Busy queue": Queue<cluster{"Timestamp": u32, "Busy or Idle": u32}>, "Track Chain State queue": Queue<T6>, "Track Received MAC Address": Queue<T7>}
  T8 = cluster{"Timestamp": u32, "Chain State Enum": u32}
diagram:
  call "802.11 Open FPGA Target.gvi"(RIO device=$device, error in=$"error in", USRP bandwidth=$"USRP bandwidth") -> (FPGA interface=w1, error out=w2, RF loop clock frequency=w3)
  FPGA Download Node(error in=w2, reference in=w1) -> (error out=w4, reference out=w5)
  FPGA Run Node(error in=w4, reference in=w5) -> (error out=w6, reference out=w7)
  Type Cast(type="802.11 FGPA Reference.gtype" constant, x=w7) -> w8
  Property Node(instance in="802.11 Host Session.gtype" {all zero or empty}, "FPGA interface"=w8) -> (instance out=w9)
  call "802.11 Setup FPGA Target.gvi"(Reference Clock=$"reference clock", session in=w9, error in=w6) -> (session out=w10, error out=w11)
  Obtain Queue(create if not found?=TRUE, element data type=u8[] [], error in=w6, max queue size=-1) -> (error out=w12, queue out=w13)
  Obtain Queue(create if not found?=TRUE, element data type=u8[] [], error in=w6, max queue size=-1) -> (error out=w14, queue out=w15)
  Obtain Queue(create if not found?=TRUE, element data type=T5 {all zero or empty}, error in=w6, max queue size=-1) -> (error out=w16, queue out=w17)
  Obtain Queue(create if not found?=TRUE, element data type=T1 {all zero or empty}, error in=w6, max queue size=-1) -> (error out=w18, queue out=w19)
  Property Node(instance in=w10, "send queue"=w13, "receive queue"=w15, "queue out"=w17, "RF loop clock frequency"=w3, "receive throughput queue"=w19) -> (instance out=w20)
  $"session out" <- w20
  call "802.11 Setup DMA FIFOs.gvi"(FPGA interface=w8, error in=w6) -> (error out=w21, H2T TX Data FIFO: actual depth=w22)
  w23 = cluster{"Timestamp": u32, "Busy or Idle": u32} {all zero or empty}
  Obtain Queue(create if not found?=TRUE, element data type=w23, error in=w6, max queue size=-1) -> (error out=w24, queue out=w25)
  Obtain Queue(create if not found?=TRUE, element data type=T8 {all zero or empty}, error in=w6, max queue size=-1) -> (error out=w26, queue out=w27)
  Obtain Queue(create if not found?=TRUE, element data type=T7 {all zero or empty}, error in=w6, max queue size=-1) -> (error out=w28, queue out=w29)
  Merge Errors(w11, w21, w12, w14, w16, w18, w24, w26, w28) -> (error out=w30)
  $"error out" <- w30
  Property Node(instance in="Custom session.gtype" {all zero or empty}, "H2T TX Data FIFO: actual depth"=w22, "Track CCA Busy queue"=w25, "Track Chain State queue"=w27, "Track Received MAC Address"=w29) -> (instance out=w31)
  $"custom session out" <- w31
