vi "802.11 Moving Average.gvi"   [LabVIEW Communications System Design Suite 2.0.1]
# Computes a cumulative moving average by calculating:
# CMA_(n+1)=CMA_n + frac(x_(n+1) - CMA_n)(n+1)
inputs:
  "sample": f64 = 1  # sample (x_(n+1)) to include in the average.
  "samples to average": u32 = 10  # Number of samples to average over (n).
  "reset": bool  # Clears the current average buffer (CMA_i = 0 forall i in [0, n)).
outputs:
  "average": f64  # Current average (CMA_(n+1)).
diagram:
  s1 = uninitialised  # shift register
  s2 = uninitialised  # shift register
  while {
    case ($reset) {
      frame False, Default {
        w1 = s1
        w2 = s2
      }
      frame True {
        To Long Integer(number=$"samples to average") -> w3
        Initialize Array(element=0, size=w3) -> w1
        w2 = 0
      }
    }
    To Double Precision Float(number=$"samples to average") -> w4
    Divide(x=$sample, y=w4) -> w5
    Replace Array Subset(inArray=w1, index=0, new=w5) -> w6
    Rotate 1D Array(array=w6, n=-1) -> (array (last n elements first)=w7)
    Array Index(array=w1) -> (out0[0]=w8)
    Negate(x=w8) -> w9
    Add(w9, w2, w5) -> w10
    next s1 = w7
    next s2 = w10
    stop if TRUE
  }
  $average <- s2
