vi "802.11 Receive RX ICP.gvi"   [LabVIEW Communications System Design Suite 2.0.1]
# Reads the ICP header and payload from RX Data DMA FIFO. The ICP header is dropped and the payload (A-MPDU) is transferred to the receive queue for further processing. The current time stamp and payload size are written to the receive throughput queue for statistics purposes.
inputs:
  "FPGA interface": "802.11 FGPA Reference.gtype"  # Interface to the device's FPGA handle.
  "error in": error
  "receive queue": Queue<u8[]>  # Queue to store the payload.
  "receive throughput queue": Queue<T1>  # Queue to store statistical information about the payload (time stamp and size).
  "enqueue decoded data": bool  # If enabled, the queues store the payload from the FIFO.
outputs:
  "error out": error
  "decoded": bool  # Indicates that an ICP packet was successfully decoded.
panel controls:
  "queue out": Queue<T2>
types:
  T1 = cluster{"Timestamp": u32, "Transferred Bytes": u32}
  T2 = cluster{"Timestamp": u32, "Transferred Bytes": u32, "Flow ID": u8}
diagram:
  w1 = 4  # ICP length field size
  w2 = 4073  # maximum possible packet size
  w3 = 500001  # error code
  w4 = 12  # ICP header size
  Add(w1, w4) -> w5
  Host Fifo Read Node[FifoName="802.11 AFW Resources.grsc\\T2H RX Data"](error in=$"error in", number of elements=0, reference in=$"FPGA interface", timeout (ms)=0) -> (elements remaining=w6, error out=w7, reference out=w8)
  Host Fifo Read Node[FifoName="802.11 AFW Resources.grsc\\T2H RX Data"](error in=w7, number of elements=w6, reference in=w8, timeout (ms)=-1) -> (data=w9, error out=w10)
  Feedback Node(input=w11) -> w12
  Build Array[ConcatenateInputs=True](w12, w9) -> w13
  s1 = w13  # shift register
  while {
    Array Size(array=s1) -> (size(s)=w14)
    Is Greater Or Equal(x=w14, y=w1) -> w15
    case (w15) {
      frame False, Default {
        w16 = FALSE
        w17 = w10
        w18 = s1
      }
      frame True {
        Array Subset(array=s1, length0=w1) -> w19
        Reverse 1D Array(array=w19) -> (reversed array=w20)
        # Read ICP length and remove from data
        call "From Byte Array (U32).gvi"(byte array in=w20) -> (element out=w21)
        To Long Integer(number=w21) -> w22
        Add(w22, w1) -> w23
        Is Greater(x=w21, y=w2) -> w24
        case (w24) {
          frame False, Default {
            w25 = w10
          }
          frame True {
            Property Node(instance in=w10, "status"=w24, "code"=w3, "source"="Target FIFO Overflow in 802.11 Receive RX ICP") -> (instance out=w25)
          }
        }
        Is Greater Or Equal(x=w14, y=w23) -> w26
        Logical And(w26, not w24) -> w16
        case (w16) {
          frame False, Default {
            w17 = w25
            w18 = s1
          }
          frame True {
            Delete From Array(inArray=s1, length (1)=w23, index0=0) -> (outArray=w18, deleted=w27)
            Delete From Array(inArray=w27, length (1)=w5, index0=0) -> w28
            Array Size(array=w28) -> (size(s)=w29)
            Split 1D Array(array=w28, index=1) -> (first subarray=w30, second subarray=w31)
            Array Index(array=w30) -> (out0[0]=w32)
            Is Greater Than 0(x=w29) -> w33
            Logical And(w33, $"enqueue decoded data") -> w34
            case (w34) {
              frame False, Default {
                w17 = w25
              }
              frame True {
                Tick Count() -> (timer value=w35)
                To Unsigned Long Integer(number=w29) -> w36
                Property Node(instance in=T2 {all zero or empty}, "Timestamp"=w35, "Transferred Bytes"=w36, "Flow ID"=w32) -> (instance out=w37)
                Enqueue Element(element=w37, queue=$"queue out", timeout in ms=-1) -> (error out=w38)
                Property Node(instance in=T1 {all zero or empty}, "Timestamp"=w35, "Transferred Bytes"=w36) -> (instance out=w39)
                Enqueue Element(element=w31, error in=w25, queue=$"receive queue", timeout in ms=-1) -> (error out=w40)
                Enqueue Element(element=w39, error in=w40, queue=$"receive throughput queue", timeout in ms=-1) -> (error out=w41)
                Merge Errors(w41, w38) -> (error out=w17)
              }
            }
          }
        }
      }
    }
    next s1 = w18
    continue if w16
  }
  w11 = s1
  $decoded <- w16
  $"error out" <- w17
