vi "802.11 Send TX ICP.gvi"   [LabVIEW Communications System Design Suite 2.0.1]
inputs:
  "FPGA interface": "802.11 FGPA Reference.gtype"  # Interface to the device's FPGA handle.
  "MCS": UFXP(4.0)  # Modulation and coding scheme index. Depending on the current 802.11 format (a or ac) and the bandwidth, valid indexes range from 0 to 7, 8 or 9.
  "device MAC address": u8[6] = [71, 111, 75, 117, 109, 97]  # Device MAC address used in the MAC frame header during transmission.
  "error in": error
  "destination MAC address": u8[6] = [71, 111, 75, 117, 109, 98]  # Destination MAC address used in the MAC frame header during transmission.
  "Flow ID": u8
  "payload": u8[]  # Payload to be transferred to the target MAC TX.
  "format": enum{"a", "ac"} = "a"  # The 802.11 format to use (currently a or ac).
  "bandwidth": enum{"20 MHz", "40 MHz", "80 MHz"} = "20 MHz"  # Bandwidth for the current packet. Enumeration type: 20 MHz, 40 MHz, 80 MHz
  "send queue": Queue<u8[]>
outputs:
  "dropped?": bool  # Indicates that the payload was not forwarded to TX Data DMA FIFO because the FIFO was full.
  "error out": error
  "FPGA Interface dup": "802.11 FGPA Reference.gtype"  # Interface to the device's FPGA handle.
  "DMA FIFO: empty elements remaining": u32
diagram:
  # Leave space
  # for more than
  # one A-MPDU.
  Feedback Node(initial value=0xFFFFFFFF, input=w1) -> w2
  Is Greater(x=w2, y=10000) -> w3
  case (w3) {
    frame False, Default {
      # Write empty array
      # to figure out free
      # elements.
      Host Fifo Write Node[FifoName="802.11 AFW Resources.grsc\\H2T TX Data"](data=u8[] [], error in=$"error in", reference in=$"FPGA interface", timeout (ms)=5000) -> (empty elements remaining=w1, error out=w6, reference out=w5)
      # 07/06/2018 Ping-Chun
      # Put the payload back to the front of send queue if there is no enough space in the DMA FIFO
      Enqueue Element At Opposite End(element=$payload, error in=w6, queue=$"send queue", timeout in ms=0) -> (error out=w7)
      Merge Errors(w6, w7) -> (error out=w4)
    }
    frame True {
      w8 = 1  # power level
      w9 = 1  # scrambler seed
      Build Array[ConcatenateInputs=True]($"Flow ID", $payload) -> w10
      # Create MPDU
      call "802.11 PHY Parameter to U8.gvi"(format=$format, bandwidth=$bandwidth, MCS=$MCS) -> (sample=w11)
      Build Array[ConcatenateInputs=True](w11, w8, w9, $"device MAC address", $"destination MAC address", w10) -> w12
      Array Size(array=w12) -> (size(s)=w13)
      To Unsigned Long Integer(number=w13) -> w14
      Split Number(x=w14) -> (high(x)=w15, low(x)=w16)
      # prepend packet size
      Split Number(x=w15) -> (high(x)=w17, low(x)=w18)
      # 01/29/2018 Yue
      # create flow id, and build array with payload
      Split Number(x=w16) -> (high(x)=w19, low(x)=w20)
      Build Array[ConcatenateInputs=True](w17, w18, w19, w20, w12) -> w21
      Host Fifo Write Node[FifoName="802.11 AFW Resources.grsc\\H2T TX Data"](data=w21, error in=$"error in", reference in=$"FPGA interface", timeout (ms)=5000) -> (empty elements remaining=w1, error out=w4, reference out=w5)
    }
  }
  $"FPGA Interface dup" <- w5
  $"DMA FIFO: empty elements remaining" <- w1
  $"error out" <- w4
  Not(x=w3) -> w22
  $"dropped?" <- w22
