vi "802.11 Open FPGA Target.gvi"   [LabVIEW Communications System Design Suite 2.0.1]
# Opens an FPGA target according to the RIO device name specified, and returns an FPGA reference.
inputs:
  "RIO device": string = "RIO0"  # Name of the RIO device to use. The device must match the project target device.
  "error in": error
  "USRP bandwidth": "USRP bandwidth.gtype" = "40 MHz"
outputs:
  "FPGA interface": "802.11 FGPA Reference.gtype"
  "error out": error
  "RF loop clock frequency": f64
types:
  "USRP bandwidth.gtype" = enum{"40 MHz", "120 MHz", "160 MHz"}
diagram:
  case ($"USRP bandwidth") {
    frame "40 MHz" {
      FPGA Open Node[ProjectItem=":NullTarget:\\802\\.11\\ FPGA\\ USRP\\ RIO\\ 40\\ MHz\\ BW\\ STA\\-26\\.lvbitx"](RIO address=$"RIO device", error in=$"error in", run?=FALSE) -> (error out=w1, reference out=w2)
      w3 = 120000000
    }
    frame "120 MHz" {
      FPGA Open Node[ProjectItem=":NullTarget:\\802\\.11\\ FPGA\\ USRP\\ RIO\\ 120\\ MHz\\ BW\\ STA\\.lvbitx"](RIO address=$"RIO device", error in=$"error in", run?=FALSE) -> (error out=w1, reference out=w2)
      w3 = 200000000
    }
    frame "160 MHz" {
      FPGA Open Node[ProjectItem=":NullTarget:\\802\\.11\\ FPGA\\ USRP\\ RIO\\ 160\\ MHz\\ BW\\ STA\\.lvbitx"](RIO address=$"RIO device", error in=$"error in", run?=FALSE) -> (error out=w1, reference out=w2)
      w3 = 200000000
    }
  }
  $"RF loop clock frequency" <- w3
  Type Cast(type="802.11 FGPA Reference.gtype" constant, x=w2) -> w4
  $"FPGA interface" <- w4
  $"error out" <- w1
