vi "Chain Table.gvi"   [LabVIEW Communications System Design Suite 2.0.1]
inputs:
  "Address 8": u8[6] = [71, 111, 75, 117, 109, 98]
  "Address 7": u8[6] = [71, 111, 75, 117, 109, 98]
  "Address 6": u8[6] = [71, 111, 75, 117, 109, 98]
  "Address 5": u8[6] = [71, 111, 75, 117, 109, 98]
  "Address 4": u8[6] = [71, 111, 75, 117, 109, 98]
  "Address 3": u8[6] = [71, 111, 75, 117, 109, 98]
  "Address 2": u8[6] = [71, 111, 75, 117, 109, 98]
  "Address 1": u8[6] = [71, 111, 75, 117, 109, 98]
outputs:
  "chain table": u64[8]
diagram:
  call "Change_U8array_to_U64.gvi"(Address 1=$"Address 1") -> (U64 mac address=w1)
  call "Change_U8array_to_U64.gvi"(Address 1=$"Address 2") -> (U64 mac address=w2)
  call "Change_U8array_to_U64.gvi"(Address 1=$"Address 3") -> (U64 mac address=w3)
  call "Change_U8array_to_U64.gvi"(Address 1=$"Address 4") -> (U64 mac address=w4)
  call "Change_U8array_to_U64.gvi"(Address 1=$"Address 5") -> (U64 mac address=w5)
  call "Change_U8array_to_U64.gvi"(Address 1=$"Address 6") -> (U64 mac address=w6)
  call "Change_U8array_to_U64.gvi"(Address 1=$"Address 7") -> (U64 mac address=w7)
  call "Change_U8array_to_U64.gvi"(Address 1=$"Address 8") -> (U64 mac address=w8)
  Build Array(w1, w2, w3, w4, w5, w6, w7, w8) -> w9
  Reverse 1D Array(array=w9) -> (reversed array=w10)
  $"chain table" <- w10
