vi "Change_U8array_to_U64.gvi"   [LabVIEW Communications System Design Suite 2.0.1]
inputs:
  "Address 1": u8[6] = [71, 111, 75, 117, 109, 98]
outputs:
  "U64 mac address": u64
diagram:
  Array Index(array=$"Address 1") -> (out0[0]=w1)
  To Unsigned Quad Integer(number=w1) -> w2
  Logical Shift(x=w2, y=40) -> w3
  Array Index(array=$"Address 1") -> (out0[1]=w4)
  To Unsigned Quad Integer(number=w4) -> w5
  Logical Shift(x=w5, y=32) -> w6
  Array Index(array=$"Address 1") -> (out0[2]=w7)
  To Unsigned Quad Integer(number=w7) -> w8
  Logical Shift(x=w8, y=24) -> w9
  Array Index(array=$"Address 1") -> (out0[3]=w10)
  To Unsigned Quad Integer(number=w10) -> w11
  Logical Shift(x=w11, y=16) -> w12
  Array Index(array=$"Address 1") -> (out0[4]=w13)
  To Unsigned Quad Integer(number=w13) -> w14
  Logical Shift(x=w14, y=8) -> w15
  Array Index(array=$"Address 1") -> (out0[5]=w16)
  To Unsigned Quad Integer(number=w16) -> w17
  Logical Shift(x=w17, y=0) -> w18
  Add(w3, w6, w9, w12, w15, w18) -> w19
  $"U64 mac address" <- w19
