vi "Get Host side total queue length.gvi"   [LabVIEW Communications System Design Suite 2.0.1]
inputs:
  "FPGA interface": "802.11 FGPA Reference.gtype"  # Interface to the device's FPGA handle.
  "send queue": Queue<u8[]>
  "custom session": "Custom session.gtype"
  "error in": error
  "packet size (bytes)": u32
outputs:
  "Host queue length (packets)": i32
  "error out": error
  "QL of H2T TX Data FIFO (packets)": i32
  "QL of send queue (packets)": i32
types:
  T1 = cluster{"Timestamp": u32, "Timing Control State Enum": u32}
  "Custom session.gtype" = cluster{"H2T TX Data FIFO: actual depth": u32, "Track CCA Busy queue": Queue<cluster{"Timestamp": u32, "Busy or Idle": u32}>, "Track Timing Control queue": Queue<T1>}
diagram:
  Host Fifo Write Node[FifoName="802.11 AFW Resources.grsc\\H2T TX Data"](data=u8[] [], error in=$"error in", reference in=$"FPGA interface", timeout (ms)=5000) -> (empty elements remaining=w1, error out=w2)
  # 07/06/2018 Ping-Chun
  # Host-side total queue length
  # = (queue length in Host send queue) + (Host-side DMA FIFO queue length)
  Get Queue Status(error in=$"error in", queue=$"send queue") -> (# elements in queue=w3, error out=w4)
  Merge Errors(w4, w2) -> (error out=w5)
  $"error out" <- w5
  $"QL of send queue (packets)" <- w3
  Property Node(instance in=$"custom session") -> ("H2T TX Data FIFO: actual depth"=w6)
  Subtract(x=w6, y=w1) -> w7
  To Double Precision Float(number=w7) -> w8
  To Double Precision Float(number=$"packet size (bytes)") -> w9
  Divide(x=w8, y=w9) -> w10
  Round Toward Negative Infinity(x=w10) -> w11
  To Long Integer(number=w11) -> w12
  Add(w3, w12) -> w13
  $"Host queue length (packets)" <- w13
  $"QL of H2T TX Data FIFO (packets)" <- w12
