vi "Print all traces.gvi"   [LabVIEW Communications System Design Suite 2.0.1]
inputs:
  "custom session": "Custom session.gtype"
  "CCA Busy trace filepath": path
  "start printing CCA log?": bool
  "error in": error
  "Chain State trace filepath": path
  "ACK Address trace filepath": path
  "start printing Chain State log?": bool
  "start printing ACK Address log?": bool
outputs:
  "error out": error
types:
  T1 = cluster{"Timestamp": u32, "Timing Control State Enum": u32}
  T2 = cluster{"Timestamp": u32, "LSB of MAC Address": u16, "MSB of MAC Address": u16}
  "Custom session.gtype" = cluster{"H2T TX Data FIFO: actual depth": u32, "Track CCA Busy queue": Queue<cluster{"Timestamp": u32, "Busy or Idle": u32}>, "Track Chain State queue": Queue<T1>, "Track Received MAC Address": Queue<T2>}
diagram:
  Property Node(instance in=$"custom session") -> ("Track CCA Busy queue"=w1, "Track Chain State queue"=w2, "Track Received MAC Address"=w3)
  case ($"start printing CCA log?") {
    frame False, Default {
      w4 = $"error in"
    }
    frame True {
      Flush Queue(error in=$"error in", queue=w1) -> (error out=w4, remaining elements=w5)
      for {
        w6 = each element of w5
        Property Node(instance in=w6) -> ("Timestamp"=w7, "Busy or Idle"=w8)
        To Unsigned Long Integer(number=w7) -> w9
        Build Array(w9, w8) -> w10
        To Quad Integer(number=w10) -> w11
        call "Write to Spreadsheet File (I64).gvi"(file path=$"CCA Busy trace filepath", 1D data=w11, append to file?=TRUE, delimiter=",", transpose?=FALSE, format="%d")
      }
    }
  }
  case ($"start printing Chain State log?") {
    frame False, Default {
      w12 = $"error in"
    }
    frame True {
      Flush Queue(error in=$"error in", queue=w2) -> (error out=w12, remaining elements=w13)
      for {
        w14 = each element of w13
        Property Node(instance in=w14) -> ("Timestamp"=w15, "Timing Control State Enum"=w16)
        To Unsigned Long Integer(number=w15) -> w17
        Build Array(w17, w16) -> w18
        To Quad Integer(number=w18) -> w19
        call "Write to Spreadsheet File (I64).gvi"(file path=$"Chain State trace filepath", 1D data=w19, append to file?=TRUE, delimiter=",", transpose?=FALSE, format="%d")
      }
    }
  }
  case ($"start printing ACK Address log?") {
    frame False, Default {
      w20 = $"error in"
    }
    frame True {
      Flush Queue(error in=$"error in", queue=w3) -> (error out=w20, remaining elements=w21)
      for {
        w22 = each element of w21
        Property Node(instance in=w22) -> ("Timestamp"=w23, "LSB of MAC Address"=w24, "MSB of MAC Address"=w25)
        To Unsigned Long Integer(number=w23) -> w26
        To Unsigned Long Integer(number=w24) -> w27
        To Unsigned Long Integer(number=w25) -> w28
        Build Array(w26, w27, w28) -> w29
        To Quad Integer(number=w29) -> w30
        call "Write to Spreadsheet File (I64).gvi"(file path=$"ACK Address trace filepath", 1D data=w30, append to file?=TRUE, delimiter=",", transpose?=FALSE, format="%d")
      }
    }
  }
  Merge Errors(w4, w12, w20) -> (error out=w31)
  $"error out" <- w31
