vi "Read Timing Control Timstamps.gvi"   [LabVIEW Communications System Design Suite 2.0.1]
inputs:
  "FPGA interface": "802.11 FGPA Reference.gtype"  # Interface to the device's FPGA handle.
  "custom session": "Custom session.gtype"
  "error in": error
outputs:
  "error out": error
types:
  T1 = cluster{"Timestamp": u32, "Timing Control State Enum": u32}
  "Custom session.gtype" = cluster{"H2T TX Data FIFO: actual depth": u32, "Track CCA Busy queue": Queue<cluster{"Timestamp": u32, "Busy or Idle": u32}>, "Track Timing Control queue": Queue<T1>}
diagram:
  Property Node(instance in=$"custom session") -> ("Track Timing Control queue"=w1)
  Host Fifo Read Node[FifoName="802.11 AFW Resources.grsc\\T2H Track Timing Control"](error in=$"error in", number of elements=0, reference in=$"FPGA interface", timeout (ms)=0) -> (elements remaining=w2, error out=w3, reference out=w4)
  Host Fifo Read Node[FifoName="802.11 AFW Resources.grsc\\T2H Track Timing Control"](error in=w3, number of elements=w2, reference in=w4, timeout (ms)=-1) -> (data=w5, error out=w6)
  for {
    w7 = each element of w5
    Split Number(x=w7) -> (high(x)=w8, low(x)=w9)
    Property Node(instance in=T1 {all zero or empty}, "Timing Control State Enum"=w8, "Timestamp"=w9) -> (instance out=w10)
    Enqueue Element(element=w10, error in=w6, queue=w1, timeout in ms=0) -> (error out=w11)
  }
  $"error out" <- w11
