vi "802.11 Host.gvi"   [LabVIEW Communications System Design Suite 2.0.1]
panel controls:
  "Trigger TX": bool
  "Clear events": bool
  "Operation Mode": T2 = "RF Multi Station"
  "Primary Subband": UFXP(2.0) = 1
  "Transmit IP Address": string = "127.0.0.1"
  "Transmit Port": u16 = 12346
  "Receive Port": u16 = 12345
  "Tab": i32 = 1
  "Power Level [dBm]": f64
  "TX Frequency [Hz]": f64 = 2500000000
  "Destination MAC Address": u8[6] = [71, 111, 75, 117, 109, 97]
  "Device MAC Address": u8[6] = [71, 111, 75, 117, 109, 107]
  "TX Port (USRP only)": enum{"TX1/RF 0", "TX1/RF 1"} = "TX1/RF 0"
  "RX Port (USRP only)": T3 = "RX2/RF 1"
  "AGC": bool = TRUE
  "Manual RX gain [dB]": f64 = 37.5
  "PN Data Packet Size": i32 = 2000
  "Subcarrier Format": i32 = "20 MHz (IEEE 802.11 a)"(0)
  "Stop": bool
  "RIO Device": string = "RIO0"
  "Station": bool = TRUE
  "reset TX staistics": bool
  "reset RX staistics": bool
  "PN Packets per Second": u32 = 5000
  "Transmit ACK": bool = TRUE
  "Backoff": u16 = 4
  "All": bool
  "None": bool
  "Events to Track": T5
  "CCA Energy Detection Threshold [dBm]": FXP(10.3) = -72
  "MCS": UFXP(4.0) = 4
  "session": "802.11 Host Session.gtype" = {"PN packet"=[118, 118, 209, 60, 246, 41, 244, 9, 181, 17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], "USRP session"={"Data Clock Rate"=120000000, "Radio Settings Bus Semaphore"=1693450245, "DB Queues"=[refnum, refnum], "Characterization Data Valid?"=TRUE, "EEPROM Header"={"Checksum"=0, "Product Code"=30513, "Hardware Current Version"=6, "Hardware Oldest Compatible Version"=4, "EEPROM Map Current Version"=2, "EEPROM Map Oldest Compatible Version"=2, "User Password"="", "Pointer to Factory Header"=64, "Pointer to User Header"=4294967295, "Recommended Interval"=24, "Number of Reserved Bytes"=9, "Number of Daughterboards"=2, "Daughterboard IDs"=[103, 103], "Daughterboard Serial Numbers"=["F59F67\u0000\u0000\u0000", "F59F67\u0000\u0000\u0000"]}, "Device Data Header"={"Checksum"=0, "Number of Channels"=4, "Number of Gain Settings"=[1, 1, 1, 1], "Pointer to Characterization Data"=[192, 11720, 17512, 29040], "Number of Reserved Bytes"=27, "Number of Frequencies"=[480, 241, 480, 241]}, "EEPROM Characterization Header"={"Checksum"=0, "Date"=2014-09-23T14:38:47Z, "Temperature"=25, "Misc. Info"="", "Pointer to Device Data Header"=128, "Number of Reserved Bytes"=28}, "Characterization Data"=[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], "FPGA Current Version"=3, "FPGA Oldest Compatible Version"=3, "Fixed Logic Current Version"=4, "Fixed Logic Oldest Compatible Version"=1, "FPGA Radio Settings Bus Current Version"=2, "FPGA Radio Settings Bus Oldest Compatible Version"=2, "FPGA Board Config Current Version"=2, "FPGA Board Config Oldest Compatible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
  "Data Source Option": i32 = 1
  "Data Sink Options": i32
  "Data Source": enum{"UDP", "PN Data", "Manual"} = "PN Data"
  "Data Sink": enum{"Off", "UDP"} = "Off"
  "Reference Clock": string = "Internal"
  "USRP bandwidth": "USRP bandwidth.gtype" = "40 MHz"
  "session additional": "Session additional.gtype"
  "packet trace filepath": path
  "start printing?": bool
panel indicators:
  "Events": string
  "MAC TX Statistic": T1
  "Baseband Power": f64
  "Coerced LO frequency TX [Hz]": f64
  "Coerced LO frequency RX [Hz]": f64
  "Channel Estimation": cluster{"Element 1": i32[], "Element 2": f64[]}[]
  "TX Block Error Rate": f64
  "Coerced Power Level [dBm]": f64
  "RX Throughput": f64
  "Applied RX Gain [dB]": f64
  "RX Throughput [bits/s]": f64
  "Current TX Block Error Rate (BLER)": f64
  "RX Frequency [Hz]": f64
  "Overwritten by Device MAC Address": bool
  "Station Active": bool
  "Device Ready": bool
  "Baseband RX Power [dBFS]": f64
  "RX Constellation": c128[]
  "RX Power Spectrum": T4
  "TX Power Spectrum": T4
  "Data Transfer": bool
  "FIFO Full": bool
  "FIFO Full": bool
  "Data Transfer": bool
  "Compensated CFO [Hz]": f64
  "TX Data Dropped": bool
  "modulation and coding rate": string
  "MAC RX Statistic": T10
  "Target FIFO Overflow": bool
  "RF Input Power": f64[][]
  "QL of received packet trace queue": i32
types:
  T1 = cluster{"TX after SIFS Requests Detected": u32, "TX after SIFS Requests Completed": u32, "TX after Backoff Requests Detected": u32, "TX after Backoff Requests Completed": u32}
  T2 = enum{"Baseband Loopback", "RF Loopback", "RF Multi Station"}
  T3 = enum{"RX1/RF 0", "RX2/RF 0", "RX1/RF 1", "RX2/RF 1"}
  T4 = cluster{"f0": f64, "df": f64, "magnitude": f64[]}
  T5 = cluster{"PhyTxStart": bool, "PhyTxEnd": bool, "PhyRxStart": bool, "PhyRxEnd": bool, "MacChannelState": bool, "MacTxStatus": bool, "PhyCcaTiming": bool, "PhyCcaTiming_2": bool, "PhyCcaTiming_3": bool}
  T6 = cluster{"Timestamp": u32, "Transferred Bytes": u32}
  T7 = cluster{"fpga ref": any, "bus instance": u32, "instruction FIFO depth": u32, "executing on FPGA target": bool, "show error call chain": bool}
  T8 = cluster{"Actual Gain [dB]": f64, "Attenuation Table Index": i32}
  T9 = cluster{"Attenuation Table [dB]": f64[][], "Frequencies [Hz]": f64[], "IQ Imbalance Table": "niUsrpRio Config v1 Host.lvlib__IQ Imbalance.gtype"[], "Gain Table": T8[][]}
  "niInstr Register Bus v0 Host.lvlib__Register Bus Session.gtype" = Queue<"niInstr Register Bus v0 Host.lvlib__Session Data.gtype">
  "Semaphore RefNum.gtype" = i32
  "niUsrpRio Config v1 Host.lvlib__DB Queue Reference.gtype" = Queue<"niUsrpRio Config v1 Host.lvlib__Daughterboard Data.gtype">
  "niUsrpRio Config v1 Host.lvlib__niUsrpRio Session.gtype" = cluster{"FPGA Interface": any, "RIO Interface Number": u32, "Data Clock Rate": u32, "FPGA Data Clock Rate": u32, "Global Settings Register Bus": "niInstr Register Bus v0 Host.lvlib__Register Bus Session.gtype", "Radio 0 Settings Register Bus": "niInstr Register Bus v0 Host.lvlib__Register Bus Session.gtype", "Radio 1 Settings Register Bus": "niInstr Register Bus v0 Host.lvlib__Register Bus Session.gtype", "Radio Settings Bus Semaphore": "Semaphore RefNum.gtype", "DB Queues": "niUsrpRio Config v1 Host.lvlib__DB Queue Reference.gtype"[], "Characterization Data Valid?": bool, "EEPROM Header": "niUsrpRio Config v1 Host.lvlib__EEPROM Header.gtype", "Device Data Header": "niUsrpRio Config v1 Host.lvlib__EEPROM Device Data Header.gtype", "EEPROM Characterization Header": "niUsrpRio Config v1 Host.lvlib__EEPROM Characterization Header.gtype", "Characterization Data": "niUsrpRio Config v1 Host.lvlib__Characterization Data.gtype"[], "FPGA Current Version": u32, "FPGA Oldest Compatible Version": u32, "Fixed Logic Current Version": u32, "Fixed Logic Oldest Compatible Version": u32, "FPGA Radio Settings Bus Current Version": u32, "FPGA Radio Settings Bus Oldest Compatible Version": u32, "FPGA Board Config Current Version": u32, "FPGA Board Config Oldest Compatible Version": u32, "Daughterboard Clock Rate": u32}
  "802.11 Host Session.gtype" = cluster{"FPGA interface": "802.11 FGPA Reference.gtype", "send queue": Queue<u8[]>, "receive queue": Queue<u8[]>, "receive throughput queue": Queue<T6>, "UDP Receiver": UdpNetworkConnectionRefnum, "PN packet": u8[], "FlexRIO session": Queue<T7>, "FlexRIO TX Characterization Data": T9, "FlexRIO RX Characterization Data": T9, "USRP session": "niUsrpRio Config v1 Host.lvlib__niUsrpRio Session.gtype", "RF loop clock frequency": f64}
  T10 = cluster{"Packet Starts detected": u32, "Frames from PHY": u32, "Frames with FCS pass": u32, "ACKs Received": u32}
  "USRP bandwidth.gtype" = enum{"40 MHz", "120 MHz", "160 MHz"}
  T11 = cluster{"LSB of MAC address": u8, "FPGA Timestamp of the Received Packet": u32}
  "Session additional.gtype" = cluster{"Received packet trace queue": Queue<T11>}
  T12 = cluster{"TX after SIFS requests detected": u32, "TX after SIFS requests completed": u32, "TX after backoff requests detected": u32, "TX after backoff requests completed": u32}
  T13 = cluster{"Frames detected": u32, "Subframes received": u32, "Valid subframes received": u32, "ACKs received": u32}
  T14 = cluster{"PhyTxStart": bool, "PhyTxEnd": bool, "PhyRxStart": bool, "PhyRxEnd": bool, "MacChannelState": bool, "MacTxStatus": bool, "PhyCcaTiming": bool, "PhyRxGainChange": bool, "PhyRxAGCStateChange": bool}
  T15 = cluster{"remove header": bool, "block unsupported frame types": bool, "block FCS errors": bool, "block address mismatch": bool, "block header recognize error": bool}
diagram:
  sequence {
    frame 0 {
      $Events <- EmptyString
      $"Device Ready" <- FALSE
      $"Station Active" <- FALSE
      $Station <- FALSE
      $"RX Constellation" <- c128[] []
      $"RX Power Spectrum" <- T4 {all zero or empty}
      $"TX Power Spectrum" <- T4 {all zero or empty}
      $"Channel Estimation" <- cluster{"Element 1": i32[], "Element 2": f64[]}[] []
      $"MAC TX Statistic" <- T12 {all zero or empty}
      $"MAC RX Statistic" <- T13 {all zero or empty}
      $"Current TX Block Error Rate (BLER)" <- 0
      $"RX Throughput [bits/s]" <- 0
      $"Compensated CFO [Hz]" <- 0
      for (N = 51) {
        $"RX Throughput" <- NaN
        $"TX Block Error Rate" <- NaN
        $"Baseband Power" <- NaN
      }
      Initialize Array(element=NaN, size=51, size=2) -> w1
      $"RF Input Power" <- w1
    }
  }
  call "Create Stop Notifier.gvi"(error in=no error) -> (error out=w2)
  call "802.11 Host Init.gvi"(device=$"RIO Device", error in=w2, reference clock=$"Reference Clock", USRP bandwidth=$"USRP bandwidth") -> (session out=w3, session additional out=w4, error out=w5)
  case (w5) {
    frame Error {
      w6 = w5
    }
    frame No Error {
      $"Device Ready" <- TRUE
      $session <- w3
      $"session additional" <- w4
      w6 = w5
    }
  }
  s1 = w6  # shift register
  while {
    # RX Reception
    call "802.11 Unbundle Session.gvi"(session=$session) -> (FPGA interface=w7, receive queue=w8, receive throughput queue=w9)
    call "802.11 Unbundle Session Additional.gvi"(session additional=$"session additional") -> (Received packet trace queue=w10)
    call "802.11 Receive RX ICP for QChain.gvi"(FPGA interface=w7, error in=s1, receive queue=w8, receive throughput queue=w9, enqueue decoded data=$"Station Active", Received packet trace queue=w10) -> (error out=w11, QL of received packet trace queue=w12)
    call "Print packet trace.gvi"(Received packet trace queue=w10, packet trace filepath=$"packet trace filepath", start printing?=$"start printing?", error in=s1) -> (error out=w13)
    Merge Errors(w13, w11) -> (error out=w14)
    call "Check Stop.gvi"(error in=w14) -> (error out=w15, stop=w16)
    $"QL of received packet trace queue" <- w12
    Wait Until Next Multiple(multiple to wait=0)
    next s1 = w15
    stop if w16
  }
  call "Stop On Error.gvi"(error in=s1) -> (error out=w17)
  s2 = w6  # shift register
  s3 = string[] []  # shift register
  while {
    call "802.11 Unbundle Session.gvi"(session=$session) -> (FPGA interface=w18)
    call "802.11 Prepare Constellation.gvi"(FPGA interface=w18, error in=s2, maximal number of subcarriers=4800) -> (error out=w19, data field constellation=w20, update constellation=w21)
    # update plots and indicators (slow)
    Logical And($"Station Active", w21) -> w22
    case (w22) {
      frame False { }
      frame True {
        $"RX Constellation" <- w20
      }
    }
    call "802.11 Read Event FIFO.gvi"(FPGA interface=w18, error in=s2) -> (raw events=w23, error out=w24)
    call "802.11 Prepare RX Power Spectrum.gvi"(FPGA interface=w18, error in=s2) -> (error out=w25, RX power spectrum=w26, update power spectrum=w27)
    call "802.11 Prepare TX Power Spectrum.gvi"(FPGA interface=w18, error in=s2) -> (error out=w28, TX power spectrum=w29, update power spectrum=w30)
    call "802.11 Prepare Channel Estimation.gvi"(FPGA interface=w18, error in=s2, channel subband=$"Primary Subband", subcarrier format=$"Subcarrier Format") -> (error out=w31, channel estimation=w32, update power spectrum=w33)
    call "802.11 Read Target Registers.gvi"(FPGA interface=w18, error in=s2) -> (error out=w34, target FIFO overflow=w35, compensated CFO=w36, RF input power=w37, MAC RX statistics=w38, MAC TX statistics=w39, signal power at packet start=w40)
    Merge Errors(w19, w25, w28, w31, w34, w24) -> (error out=w41)
    call "Check Stop.gvi"(error in=w41) -> (error out=w42, stop=w43)
    Logical And($"Station Active", w27) -> w44
    case (w44) {
      frame False, Default { }
      frame True {
        $"RX Power Spectrum" <- w26
      }
    }
    Logical And($"Station Active", w30) -> w45
    case (w45) {
      frame False, Default { }
      frame True {
        $"TX Power Spectrum" <- w29
      }
    }
    Logical And($"Station Active", w33) -> w46
    case (w46) {
      frame False, Default { }
      frame True {
        $"Channel Estimation" <- w32
      }
    }
    $"Target FIFO Overflow" <- w35
    $"Compensated CFO [Hz]" <- w36
    $"RF Input Power" <- w37
    $"Baseband Power" <- w40
    $"MAC RX Statistic" <- w38
    $"MAC TX Statistic" <- w39
    call "802.11 Events to String.gvi"(event data=w23, events to track=$"Events to Track") -> (event strings=w47)
    for {
      w48 = each element of w47
      Match Pattern(regular expression="PhyRxStart.ind ", string=w48) -> (offset past match=w50)
      Is Not Equal(x=w50, y=-1) -> w51
      append w51 to w49
    }
    Or Array Elements(Boolean array=w49)
    w52 = -12  # CFX data type offset
    Add(w40, w52) -> w53
    $"Baseband RX Power [dBFS]" <- w53
    Build Array[ConcatenateInputs=True](s3, w47) -> w54
    Delete From Array(inArray=w54, length (1)=10000) -> (deleted=w55)
    Select(s=$"Clear events", t=string[] [], f=w55) -> w56
    Concatenate Strings(w55) -> w57
    $Events <- w57
    Select(s=$None, t=T14 {all zero or empty}, f=$"Events to Track") -> w58
    w59 = T14 {"PhyTxStart"=TRUE, "PhyTxEnd"=TRUE, "PhyRxStart"=TRUE, "PhyRxEnd"=TRUE, "MacChannelState"=TRUE, "MacTxStatus"=TRUE, "PhyCcaTiming"=TRUE, "PhyRxGainChange"=TRUE, "PhyRxAGCStateChange"=TRUE}
    Select(s=$All, t=w59, f=w58) -> w60
    $"Events to Track" <- w60
    Wait Until Next Multiple(multiple to wait=250)
    next s2 = w42
    next s3 = w56
    stop if w43
  }
  call "Stop On Error.gvi"(error in=s2) -> (error out=w61)
  s4 = w6  # shift register
  while {
    Feedback Node(input=$"Station Active") -> w62
    Is Not Equal(x=$"Station Active", y=w62) -> w63
    # update plots and indicators (fast)
    case ($"Station Active") {
      frame False, Default {
        w64 = s4
      }
      frame True {
        call "802.11 Unbundle Session.gvi"(session=$session) -> (FPGA interface=w65, receive throughput queue=w66)
        call "802.11 Prepare Throughput Measurements.gvi"(reset=w63, FPGA interface=w65, receive throughput queue=w66, error in=s4, timing granularity=100) -> (error out=w64, TX block error rate=w67, RX throughput=w68)
        $"Current TX Block Error Rate (BLER)" <- w67
        $"TX Block Error Rate" <- w67
        $"RX Throughput [bits/s]" <- w68
        Divide(x=w68, y=1000000) -> w69
        $"RX Throughput" <- w69
      }
    }
    call "Check Stop.gvi"(error in=w64) -> (error out=w70, stop=w71)
    Wait Until Next Multiple(multiple to wait=100)
    next s4 = w70
    stop if w71
  }
  call "Stop On Error.gvi"(error in=s4) -> (error out=w72)
  Udp Open(error in=w6, net address=0, port=0, service name="", timeout ms=25000) -> (connection ID=w73, error out=w74)
  call "Set Socket Option.gvi"(connection in=w73, level=0xFFFF, option name=0x1001, value=1024000, error in=w74) -> (error out=w75, connection out=w76)
  s5 = w75  # shift register
  s6 = w76  # shift register
  while {
    # UDP send and receive
    call "802.11 Unbundle Session.gvi"(session=$session) -> (send queue=w77, receive queue=w78, UDP receiver=w79, PN packet=w80)
    case ($"Station Active") {
      frame False, Default {
        w81 = s5
        w82 = s6
      }
      frame True {
        Array Subset(array=w80, length0=$"PN Data Packet Size") -> w83
        case ($"Data Source") {
          frame "UDP" {
            # UDP
            call "802.11 Receive UDP Data.gvi"(UDP receiver=w79, send queue=w77, error in=s5) -> (data transfer=w85, error out=w84, FIFO full=w86)
            $"FIFO Full" <- w86
          }
          frame "PN Data" {
            # PN data
            call "802.11 Send PN Data.gvi"(PN packets per second=$"PN Packets per Second", send queue=w77, PN data=w83, error in=s5) -> (data transfer=w85, error out=w84)
          }
          frame "Manual", Default {
            # Manual
            case ($"Trigger TX") {
              frame False, Default {
                w84 = s5
                w85 = $"Trigger TX"
              }
              frame True {
                Enqueue Element(element=w83, error in=s5, queue=w77, timeout in ms=-1) -> (error out=w84, queue out=w87)
                w85 = $"Trigger TX"
              }
            }
          }
        }
        $"Data Transfer" <- w85
        Is Equal(x=$"Data Sink", y="UDP") -> w88
        call "802.11 Send UDP Data.gvi"(target port=$"Transmit Port", target IP address=$"Transmit IP Address", receive queue=w78, UDP sender=s6, enable=w88, error in=s5) -> (FIFO full=w89, error out=w90, UDP sender dup=w82, data transfer=w91)
        $"Data Transfer" <- w91
        $"FIFO Full" <- w89
        Merge Errors(w84, w90) -> (error out=w81)
      }
    }
    call "Check Stop.gvi"(error in=w81) -> (error out=w92, stop=w93)
    Wait Until Next Multiple(multiple to wait=0)
    next s5 = w92
    next s6 = w82
    stop if w93
  }
  call "Stop On Error.gvi"(error in=s5) -> (error out=w94)
  Udp Close(connection ID=s6, error in=w94) -> (error out=w95)
  s7 = w6  # shift register
  while {
    # TX transmission
    call "802.11 Unbundle Session.gvi"(session=$session) -> (FPGA interface=w96, send queue=w97)
    w98 = $"Station Active"
    while {
      Dequeue Element(error in=s7, queue=w97, timeout in ms=0) -> (element=w99, error out=w100, timed out?=w101)
      Logical And(w98, not w101) -> w102
      case (w102) {
        frame False {
          w103 = w100
        }
        frame True {
          call "802.11 Subcarrier Format to Configuration.gvi"(MCS=$MCS, subcarrier format=$"Subcarrier Format", error in=w100) -> (error out=w104, format=w105, bandwidth=w106, valid configuration=w107)
          Is Not Equal(x=$"Operation Mode", y="RF Multi Station") -> w108
          Select(s=w108, t=$"Device MAC Address", f=$"Destination MAC Address") -> w109
          case (w107) {
            frame False, Default {
              w110 = FALSE
              w103 = w104
            }
            frame True {
              call "802.11 Send TX ICP.gvi"(FPGA interface=w96, MCS=$MCS, device MAC address=$"Device MAC Address", error in=w104, destination MAC address=w109, payload=w99, format=w105, bandwidth=w106) -> (dropped?=w110, error out=w103)
            }
          }
          $"TX Data Dropped" <- w110
          $"Overwritten by Device MAC Address" <- w108
        }
      }
      call "Check Stop.gvi"(error in=w103) -> (error out=w111, stop=w112)
      Logical Or(w112, w101) -> w113
      stop if w113
    }
    call "Check Stop.gvi"(error in=w111) -> (error out=w114, stop=w115)
    Wait Until Next Multiple(multiple to wait=0)
    next s7 = w114
    stop if w115
  }
  call "Stop On Error.gvi"(error in=s7) -> (error out=w116)
  s8 = w6  # shift register
  while {
    # configuration
    call "802.11 Unbundle Session.gvi"(session=$session) -> (FPGA interface=w117)
    Feedback Node(input=$"Station Active") -> w118
    case ($"Station Active") {
      frame False, Default {
        w119 = s8
      }
      frame True {
        Is Not Equal(x=$"Station Active", y=w118) -> w120
        call "802.11 Gain Control.gvi"(initialize=w120, RX Port (USRP only)=$"RX Port (USRP only)", session=$session, AGC=$AGC, error in=s8, Manual RX gain [dB]=$"Manual RX gain [dB]", RX Frequency [Hz]=$"RX Frequency [Hz]", TX Port (USRP only)=$"TX Port (USRP only)") -> (Applied RX Gain [dB]=w121, error out=w122)
        $"Applied RX Gain [dB]" <- w121
        call "802.11 Subcarrier Format to Configuration.gvi"(MCS=$MCS, subcarrier format=$"Subcarrier Format", error in=s8) -> (error out=w123, format=w124)
        call "802.11 Configure Dynamic Parameters.gvi"(FPGA interface=w117, error in=w123, format=w124, transmit ACK=$"Transmit ACK", backoff value=$Backoff, CCA energy detection threshold=$"CCA Energy Detection Threshold [dBm]") -> (error out=w125)
        Merge Errors(w122, w125) -> (error out=w119)
      }
    }
    w126 = $Station
    Feedback Node(input=w126) -> w127
    Logical Exclusive Or(w126, w127) -> w128
    case (w128) {
      frame False, Default {
        w129 = s8
      }
      frame True {
        case (w126) {
          frame False, Default {
            sequence {
              frame 0 {
                $"Station Active" <- w126
              }
            }
            call "802.11 Unbundle Session.gvi"(session=$session) -> (UDP receiver=w130)
            Udp Close(connection ID=w130, error in=s8) -> (error out=w131)
            call "Clear Errors.gvi"(specific error code to clear=1, error in=w131) -> (error out=w132)
            call "802.11 Abort RF Streams.gvi"(session=$session, error in=w132) -> (error out=w129)
          }
          frame True {
            $"RX Frequency [Hz]" <- $"TX Frequency [Hz]"
            call "802.11 FPGA Target Configuration.gvi"() -> (maximum gain=w133, enable DC offset correction=w134)
            w135 = T15 {"remove header"=TRUE, "block unsupported frame types"=TRUE, "block FCS errors"=TRUE, "block address mismatch"=TRUE, "block header recognize error"=TRUE}
            call "802.11 Configure Static Parameters.gvi"(session in=$session, error in=s8, primary subband=$"Primary Subband", operation mode=$"Operation Mode", enable DC offset correction=w134, MPDU filter configuration=w135, device MAC address=$"Device MAC Address") -> (session dup=w136, error out=w137)
            call "802.11 Reset Statistics.gvi"(session in=w136, error in=w137, reset RX statistics=TRUE, reset TX statistics=TRUE) -> (error out=w138, session dup=w139)
            call "802.11 Configure TX RF.gvi"(TX port=$"TX Port (USRP only)", session=w139, TX frequency=$"TX Frequency [Hz]", TX power level=$"Power Level [dBm]", error in=w138) -> (session dup=w140, error out=w141, coerced TX power level=w142, coerced LO frequency=w143)
            call "802.11 Configure RX RF.gvi"(RX frequency=$"TX Frequency [Hz]", session=w140, RX gain=w133, error in=w141, RX port=$"RX Port (USRP only)") -> (error out=w144, session dup=w145, coerced RX gain=w146, coerced LO frequency=w147)
            call "802.11 Configure AGC Registers.gvi"(TX Port=$"TX Port (USRP only)", enable AGC=FALSE, session=w145, RX port=$"RX Port (USRP only)", error in=w144) -> (error out=w148, session dup=w149)
            call "802.11 Set Power Calibration Offset.gvi"(session=w149, frequency=$"TX Frequency [Hz]", error in=w148, RX port=$"RX Port (USRP only)") -> (session dup=w150, error out=w151)
            call "802.11 Configure RF Streams.gvi"(TX port=$"TX Port (USRP only)", RX port=$"RX Port (USRP only)", session=w150, error in=w151) -> (session dup=w152, error out=w153)
            call "802.11 Configure Data Source.gvi"(error in=w153, receive port=$"Receive Port", session in=w152) -> (error out=w129, session out=w154, success?=w155)
            $session <- w154
            sequence {
              frame 0 {
                $Station <- w155
                $"Station Active" <- w126
              }
            }
            $"Coerced LO frequency RX [Hz]" <- w147
            $"Applied RX Gain [dB]" <- w146
            $"Coerced LO frequency TX [Hz]" <- w143
            $"Coerced Power Level [dBm]" <- w142
          }
        }
      }
    }
    call "802.11 Reset Statistics.gvi"(session in=$session, error in=s8, reset RX statistics=$"reset RX staistics", reset TX statistics=$"reset TX staistics") -> (error out=w156)
    call "802.11 Subcarrier Format to Configuration.gvi"(MCS=$MCS, subcarrier format=$"Subcarrier Format", error in=w156) -> (modulation and coding rate=w157, error out=w158)
    Merge Errors(w119, w129, w158) -> (error out=w159)
    call "Create Stop.gvi"(error in=w159, stop in=$Stop) -> (error out=w160)
    call "Check Stop.gvi"(error in=w160) -> (error out=w161, stop=w162)
    Wait Until Next Multiple(multiple to wait=100)
    $"modulation and coding rate" <- w157
    next s8 = w161
    stop if w162
  }
  call "Stop On Error.gvi"(error in=s8) -> (error out=w163)
  Merge Errors(w163, w116, w17, w95, w61, w72) -> (error out=w164)
  sequence {
    frame 0 {
      w165 = $session
    }
  }
  call "802.11 Host Release.gvi"(session=w165, error in=w164) -> (error out=w166)
  call "Simple Error Handler.gvi"(type of dialog="OK message", error in=w166)
