vi "802.11 Receive RX ICP for QChain.gvi"   [LabVIEW Communications System Design Suite 2.0.1]
# Reads the ICP header and payload from RX Data DMA FIFO. The ICP header is dropped and the payload (A-MPDU) is transferred to the receive queue for further processing. The current time stamp and payload size are written to the receive throughput queue for statistics purposes.
inputs:
  "FPGA interface": "802.11 FGPA Reference.gtype"  # Interface to the device's FPGA handle.
  "error in": error
  "receive queue": Queue<u8[]>  # Queue to store the payload.
  "receive throughput queue": Queue<T1>  # Queue to store statistical information about the payload (time stamp and size).
  "enqueue decoded data": bool  # If enabled, the queues store the payload from the FIFO.
  "Received packet trace queue": Queue<T2>
outputs:
  "error out": error
  "decoded": bool  # Indicates that an ICP packet was successfully decoded.
  "QL of received packet trace queue": i32
types:
  T1 = cluster{"Timestamp": u32, "Transferred Bytes": u32}
  T2 = cluster{"LSB of MAC address": u8, "FPGA Timestamp of the Received Packet": u32}
diagram:
  w1 = 4  # ICP length field size
  w2 = 4  # additional ICP header size
  w3 = 4073  # maximum possible packet size
  w4 = 500001  # error code
  w5 = 12  # ICP header size
  Add(w1, w5, w2) -> w6
  Host Fifo Read Node[FifoName="802.11 AFW Resources.grsc\\T2H RX Data"](error in=$"error in", number of elements=0, reference in=$"FPGA interface", timeout (ms)=0) -> (elements remaining=w7, error out=w8, reference out=w9)
  Host Fifo Read Node[FifoName="802.11 AFW Resources.grsc\\T2H RX Data"](error in=w8, number of elements=w7, reference in=w9, timeout (ms)=-1) -> (data=w10, error out=w11)
  Feedback Node(input=w12) -> w13
  Build Array[ConcatenateInputs=True](w13, w10) -> w14
  s1 = w14  # shift register
  while {
    Array Size(array=s1) -> (size(s)=w15)
    Is Greater Or Equal(x=w15, y=w1) -> w16
    Feedback Node(input=w17) -> w18
    case (w16) {
      frame False, Default {
        w19 = FALSE
        w20 = w11
        w21 = s1
        w17 = w18
      }
      frame True {
        Array Subset(array=s1, length0=w1) -> w22
        Reverse 1D Array(array=w22) -> (reversed array=w23)
        # Read ICP length and remove from data
        call "From Byte Array (U32).gvi"(byte array in=w23) -> (element out=w24)
        To Long Integer(number=w24) -> w25
        Add(w25, w1, w2) -> w26
        Is Greater(x=w24, y=w3) -> w27
        case (w27) {
          frame False, Default {
            w28 = w11
          }
          frame True {
            Property Node(instance in=w11, "status"=w27, "code"=w4, "source"="Target FIFO Overflow in 802.11 Receive RX ICP") -> (instance out=w28)
          }
        }
        Is Greater Or Equal(x=w15, y=w26) -> w29
        Logical And(w29, not w27) -> w19
        case (w19) {
          frame False, Default {
            w20 = w28
            w21 = s1
            w17 = w18
          }
          frame True {
            Delete From Array(inArray=s1, length (1)=w26, index0=0) -> (outArray=w21, deleted=w30)
            Delete From Array(inArray=w30, length (1)=w6, index0=0) -> (outArray=w31, deleted=w32)
            Array Index(array=w32) -> (out0[15]=w33)
            Array Size(array=w31) -> (size(s)=w34)
            Is Greater Than 0(x=w34) -> w35
            Logical And(w35, $"enqueue decoded data") -> w36
            Array Index(array=w32) -> (out0[19]=w37)
            Number To Boolean Array(number=w37) -> (Boolean array=w38)
            Array Index(array=w32) -> (out0[18]=w39)
            Number To Boolean Array(number=w39) -> (Boolean array=w40)
            Array Index(array=w32) -> (out0[17]=w41)
            Number To Boolean Array(number=w41) -> (Boolean array=w42)
            # 07/03/2018 Ping-Chun
            # 1. Retrieve the Least Significant Byte of MAC address
            # 2. Retrieve the prepended FPGA global timestamp (4 bytes->U32)
            Array Index(array=w32) -> (out0[16]=w43)
            Number To Boolean Array(number=w43) -> (Boolean array=w44)
            Build Array[ConcatenateInputs=True](w38, w40, w42, w44) -> w45
            Boolean Array To Number(Boolean array=w45) -> (number=w46)
            case (w36) {
              frame False, Default {
                w47 = w28
                w17 = w18
              }
              frame True {
                Property Node(instance in=T2 {all zero or empty}, "LSB of MAC address"=w33, "FPGA Timestamp of the Received Packet"=w46) -> (instance out=w48)
                Enqueue Element(element=w48, error in=w28, queue=$"Received packet trace queue", timeout in ms=-1) -> (error out=w47)
                Get Queue Status(queue=$"Received packet trace queue") -> (# elements in queue=w17)
              }
            }
            case (w36) {
              frame False, Default {
                w49 = w28
              }
              frame True {
                Tick Count() -> (timer value=w50)
                To Unsigned Long Integer(number=w34) -> w51
                Property Node(instance in=T1 {all zero or empty}, "Timestamp"=w50, "Transferred Bytes"=w51) -> (instance out=w52)
                Enqueue Element(element=w31, error in=w28, queue=$"receive queue", timeout in ms=-1) -> (error out=w53)
                Enqueue Element(element=w52, error in=w53, queue=$"receive throughput queue", timeout in ms=-1) -> (error out=w49)
              }
            }
            Merge Errors(w49, w47) -> (error out=w20)
          }
        }
      }
    }
    $"QL of received packet trace queue" <- w17
    next s1 = w21
    continue if w19
  }
  w12 = s1
  $decoded <- w19
  $"error out" <- w20
