vi "Print packet trace.gvi"   [LabVIEW Communications System Design Suite 2.0.1]
inputs:
  "Received packet trace queue": Queue<T1>
  "packet trace filepath": path
  "start printing?": bool
  "error in": error
outputs:
  "error out": error
types:
  T1 = cluster{"LSB of MAC address": u8, "FPGA Timestamp of the Received Packet": u32}
diagram:
  case ($"start printing?") {
    frame False, Default {
      w1 = $"error in"
    }
    frame True {
      Flush Queue(error in=$"error in", queue=$"Received packet trace queue") -> (error out=w1, remaining elements=w2)
      for {
        w3 = each element of w2
        Property Node(instance in=w3) -> ("LSB of MAC address"=w4, "FPGA Timestamp of the Received Packet"=w5)
        To Unsigned Long Integer(number=w4) -> w6
        Build Array(w6, w5) -> w7
        To Quad Integer(number=w7) -> w8
        call "Write to Spreadsheet File (I64).gvi"(file path=$"packet trace filepath", 1D data=w8, append to file?=TRUE, delimiter=",", transpose?=FALSE, format="%d")
      }
    }
  }
  $"error out" <- w1
