vi "802.11 FPGA STA.gvi"   [LabVIEW Communications System Design Suite 2.0.1]
panel controls:
  "reg.host read.go rcvd 0": bool
  "reg.notify host.go rcvd 0": bool
  "reg.reset 0": bool
  "RF 0/Rx/Enable": bool
  "RF 0/Tx/Enable": bool
  "RF 1/Rx/Enable": bool
  "RF 1/Tx/Enable": bool
  "ATR State": enum{"Idle", "Rx", "Tx", "Duplex"} = "Idle"
  "Radio Control Destination": T1 = "Radio 0 Config"
  "lo lpf enable": bool
  "power enable": bool
  "mixer enable": bool
  "tx.configuration": T2 = {"power enable"=TRUE, "mixer enable"=TRUE, "gain"=0}
  "RX data source": T3 = "RF"
  "packet start sample index": u16
  "rearm packet start generator": bool
  "bypass synchronization": bool
  "reset MAC RX statistics": bool
  "noise coefficient": FXP(8.8) = 10
  "mute RX while TX active?": bool = TRUE
  "number of samples to capture": u16 = 1024
  "produce silent samples": bool
  "MPDU filter config": T7 = {"remove header"=TRUE, "block unsupported frame types"=TRUE, "block FCS errors"=TRUE, "block address mismatch"=TRUE, "block header recognize error"=TRUE}
  "power calibration offset": FXP(10.3)
  "CCA energy detect threshold": FXP(10.3) = -62
  "RF gain": FXP(10.3)
  "number of samples before trigger": u16
  "synchronization settings": T8 = {"maximal normalization threshold"=65536, "peak timing metric threshold"=0.5, "consecutive samples over threshold"=10, "valley timing metric threshold"=-0.5, "consecutive samples under threshold"=10, "autocorelation threshold"=0.5, "expected peak valley distance"=608, "maximum peak valley distance deviation"=64, "samples to shift frame start"=-32, "use static CFO?"=FALSE, "static CFO"=0}
  "trigger condition": T9 = "Immediate"
  "manual trigger": bool
  "AGC tresholds": T10
  "AGC timeout": i32 = 3500
  "enable AGC": bool
  "manual PhyTxStart.req": cluster{"TX vector": T11, "Valid": bool}
  "bypass MAC TX": bool
  "RX TX turnaround time": u32 = 24
  "reset MAC TX statistics": bool
  "suppress ACK": bool
  "backoff value": u16
  "ACK bandwidth": enum{"20 MHz", "40 MHz", "80 MHz"} = "20 MHz"
  "rx.reset": bool = TRUE
  "rx.output sample rate": UFXP(1.47)
  "rx.delay": FXP(0.16)
  "rx 0.frequency shift": FXP(0.48)
  "rx 0.phase": FXP(0.21)
  "rx 0.impairments": T13 = {"inline gain I"=-1, "inline gain Q"=0.999992370605, "cross gain I"=0.999992370605, "cross gain Q"=0, "pre-gain offset I"=0, "pre-gain offset Q"=-1, "post-gain offset I"=0, "post-gain offset Q"=0.999992370605}
  "rx.abort": bool
  "tx.abort": bool
  "tx.reset": bool = TRUE
  "tx.input sample rate": UFXP(1.47)
  "tx.delay": FXP(0.18)
  "tx 0.frequency shift": FXP(0.48)
  "tx 0.phase": FXP(0.21)
  "tx 0.impairments": T13 = {"inline gain I"=0.999992370605, "inline gain Q"=0.999992370605, "post-gain offset I"=0.999992370605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}
  "tx 0.gain": T14 = {"gain I"=1, "gain Q"=1}
  "rx 1.impairments": T13 = {"inline gain I"=-0.999992370605, "inline gain Q"=0.999992370605, "cross gain I"=-0.999992370605, "cross gain Q"=0, "pre-gain offset I"=-1, "pre-gain offset Q"=0, "post-gain offset I"=0, "post-gain offset Q"=0}
  "rx 1.frequency shift": FXP(0.48)
  "rx 1.phase": FXP(0.21)
  "tx 1.impairments": T13 = {"inline gain I"=0.999992370605, "inline gain Q"=0.999992370605, "post-gain offset I"=-1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}
  "tx 1.frequency shift": FXP(0.48)
  "tx 1.phase": FXP(0.21)
  "tx 1.gain": T14 = {"gain I"=1, "gain Q"=1}
  "rx 0.stream enable": bool
  "rx 1.stream enable": bool
  "tx 0.stream enable": bool
  "tx 1.stream enable": bool
  "Data clock cycles per tick (0.1us)": u16 = 20
  "Data clock cycles per OFDM symbol": u16 = 480
  "rx.rf channel": UFXP(1.0)
  "tx.rf channel": UFXP(1.0)
  "enable DC offset correction": bool = TRUE
  "data clock locked?": bool
  "format": enum{"a", "ac"} = "a"
  "channel selector": UFXP(2.0)
  "device MAC address": u8[6]
  "DC centered signal": bool = TRUE
  "daughterboard": "niUsrpRio Config v1 Host.lvlib__DB Types.gtype" = "sbx"
  "antenna configuration": "niUsrpRio Config v1 Host.lvlib__Antenna Configuration.gtype" = "TX1 RX1 transmits and RX2 receives"
  "spi address": u8 = 7
  "cpld enable": bool = TRUE
panel indicators:
  "reg.notify host.go 0": bool
  "reg.host read.data 0": cluster{"go": bool, "data": u32}
  "compensated CFO": FXP(0.48)
  "MAC RX statistics": T4
  "PhyRxStart.ind": T5
  "PhyRxEnd.ind": T6
  "T2H RX Data overflow": u16
  "T2H Constallation overflow": u16
  "T2H RX Bit Processing Output FIFO overflow": u16
  "T2H RX Power Spectrum overflow": u16
  "T2H Channel Estimation overflow": u16
  "last applied gain": UFXP(5.1)
  "RF input power at packet start": FXP(10.3)
  "signal power at packet start": FXP(10.3)
  "RF input power": FXP(10.3)
  "signal power": FXP(10.3)
  "out of range?": bool
  "MAC TX statistics": T12
  "PhyTxStart.req": cluster{"TX vector": T11, "Valid": bool}
  "PhyTxEnd.ind": cluster{"Valid": bool}
  "internal loopback FIFO overflow": u16
  "TX to RF FIFO overflow": u16
  "T2H TX Baseband FIFO overflow": u16
  "T2H TX Bit Processing Output FIFO overflow": u16
  "rx.samples processed": u32
  "rx.number of IQ data overflows": u64
  "rx.number of overflows": u32
  "tx.samples processed": u32
  "tx.underflows": u32
  "tx.number of IQ data overflows": u64
  "rx.dsp reset done": bool
  "tx.dsp reset done": bool
  "tx.state": "Stream Control State.gtype"
  "rx.state": "Stream Control State.gtype"
  "Timestamp": u32
  "DC average": CFXP(1.17)
types:
  T1 = enum{"Identification", "Board Config", "Global Config", "Radio 0 Config", "Radio 1 Config", "Synchronization", "Time", "Future Events"}
  T2 = cluster{"power enable": bool, "mixer enable": bool, "gain": u8}
  T3 = enum{"RF", "BB Data From Host", "Internal Loopback"}
  T4 = cluster{"number of frames detected": u32, "number of subframes received": u32, "number of valid subframes received": u32, "number of ACKs received": u32, "valid": bool}
  T5 = cluster{"Format": enum{"a", "ac"}, "Bandwidth": enum{"20 MHz", "40 MHz", "80 MHz"}, "PSDU Length": u32, "MCS": UFXP(4.0), "valid": bool}
  T6 = cluster{"Format Violation": bool, "Timing valid": bool, "Timing value": u32, "valid": bool}
  T7 = cluster{"remove header": bool, "block unsupported frame types": bool, "block FCS errors": bool, "block address mismatch": bool, "block header recognize error": bool}
  T8 = cluster{"maximal normalization threshold": UFXP(19.15), "peak timing metric threshold": FXP(2.6), "consecutive samples over threshold": u8, "valley timing metric threshold": FXP(2.6), "consecutive samples under threshold": u8, "autocorelation threshold": UFXP(2.14), "expected peak valley distance": u16, "maximum peak valley distance deviation": u8, "samples to shift frame start": i8, "use static CFO?": bool, "static CFO": FXP(0.48)}
  T9 = enum{"Immediate", "RX Packet Start", "TX Paket Start", "CCA energy detected"}
  T10 = cluster{"AGC active threshold": FXP(10.3), "AGC threshold 1": FXP(10.3), "AGC threshold 2": FXP(10.3), "AGC threshold 3": FXP(10.3)}
  T11 = cluster{"format": enum{"a", "ac"}, "bandwidth": enum{"20 MHz", "40 MHz", "80 MHz"}, "length": u32, "MCS": UFXP(4.0), "TX power level": UFXP(4.0), "Scrambler seed": UFXP(7.0)}
  T12 = cluster{"number of TX after SIFS requests detected": u32, "number of TX after SIFS requests completed": u32, "number of TX after backoff requests detected": u32, "number of TX after backoff requests completed": u32}
  T13 = cluster{"inline gain I": FXP(1.17), "inline gain Q": FXP(1.17), "cross gain I": FXP(1.17), "cross gain Q": FXP(1.17), "pre-gain offset I": FXP(1.17), "pre-gain offset Q": FXP(1.17), "post-gain offset I": FXP(1.17), "post-gain offset Q": FXP(1.17)}
  T14 = cluster{"gain I": FXP(3.21), "gain Q": FXP(3.21)}
  "Stream Control State.gtype" = enum{"Idle", "Active"}
  "niUsrpRio Config v1 Host.lvlib__DB Types.gtype" = enum{"sbx", "cbx", "wbx", "unknown", "ubx"}
  "niUsrpRio Config v1 Host.lvlib__Antenna Configuration.gtype" = enum{"TX1 RX1 transmits and RX2 receives", "TX1 RX1 receives and RX2 is unused"}
  T15 = cluster{"MPDU subtype": enum{"ACK"}, "destination MAC address": u8[6], "valid": bool}
  T16 = cluster{"CCA energy detection busy": u8, "CCA signal detection busy": bool, "frame timing valid": bool, "frame timing value": u32, "frame timing use DIFS": bool}
  T17 = cluster{"5 MHz": bool, "10 MHz": bool, "20 MHz": bool, "40 MHz": bool, "80 Mhz": bool, "160 MHz": bool}
  T18 = cluster{"format": enum{"a", "ac"}, "channel selector": UFXP(2.0), "device MAC address": u8[6], "DC centered signal": bool, "supported bandwidths": T17}
  T19 = cluster{"global timestamp": RegisterDataType<u32>, "OFDM symbol pulse": RegisterDataType<bool>, "TX active": RegisterDataType<bool>, "channel state indication": RegisterDataType<T16>, "MPDU generation request": RegisterDataType<T15>, "shared properties": RegisterDataType<T18>}
  T20 = cluster{"CCA energy detection busy": u8, "CCA signal detection busy": bool}
  T21 = enum{"Idle", "Wait for second measurement", "AGC active", "Gain locked"}
  T22 = cluster{"trigger gain setting": bool, "gain": UFXP(5.1)}
  "802.11 PHY-SAP.gtype" = cluster{"PSDU (RX)": any, "PSDU (TX)": any, "CCA detection": RegisterDataType<T20>, "PhyRxStart.req": HandshakeDataType<T5>, "PhyRxEnd.ind": HandshakeDataType<T6>, "channel state indication": HandshakeDataType<T16>, "PhyTxStart.req": HandshakeDataType<cluster{"TX vector": T11, "Valid": bool}>, "PhyTxEnd.ind": HandshakeDataType<cluster{"Valid": bool}>, "PHY RX AGC state indication": HandshakeDataType<cluster{"AGC state": T21, "AGC enabled": bool}>, "PHY RX Gain change indication": HandshakeDataType<T22>}
  T23 = cluster{"RF to RX FIFO": any, "internal loopback FIFO": any, "TX to RF FIFO": any, "Gain Settings FIFO": any}
  T24 = cluster{"output sample rate": UFXP(1.47), "delay": FXP(0.16), "frequency shift": FXP(0.48), "impairments": T13, "phase": FXP(0.21)}
  T25 = cluster{"frequency shift": FXP(0.48), "impairments": T13, "phase": FXP(0.21), "input sample rate": UFXP(1.47), "gain": T14, "delay": FXP(0.18)}
diagram:
  Register Create(initial value=0) -> (reference out=w1)
  Register Create(initial value=FALSE) -> (reference out=w2)
  w3 = T15 {"MPDU subtype"="ACK", "destination MAC address"=[0, 0, 0, 0, 0, 0], "valid"=FALSE}
  Register Create(initial value=w3) -> (reference out=w4)
  Register Create(initial value=FALSE) -> (reference out=w5)
  Register Create(initial value=T16 {all zero or empty}) -> (reference out=w6)
  w7 = T18 {"format"="a", "channel selector"=0, "device MAC address"=[0, 0, 0, 0, 0, 0], "DC centered signal"=FALSE, "supported bandwidths"={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}}
  Register Create(initial value=w7) -> (reference out=w8)
  Property Node(instance in=T19 {all zero or empty}, "global timestamp"=w1, "MPDU generation request"=w4, "channel state indication"=w6, "TX active"=w5, "OFDM symbol pulse"=w2, "shared properties"=w8) -> (instance out=w9)
  FIFO Create(data type=u8 0) -> (reference out=w10)
  FIFO Create(data type=u8 0) -> (reference out=w11)
  Register Create(initial value=T20 {all zero or empty}) -> (reference out=w12)
  Handshake Create(data type=T5 {all zero or empty}) -> (reference out=w13)
  Handshake Create(data type=T6 {all zero or empty}) -> (reference out=w14)
  Handshake Create(data type=T16 {all zero or empty}) -> (reference out=w15)
  Handshake Create(data type=cluster{"TX vector": T11, "Valid": bool} {all zero or empty}) -> (reference out=w16)
  Handshake Create(data type=cluster{"Valid": bool} {all zero or empty}) -> (reference out=w17)
  w18 = cluster{"AGC state": T21, "AGC enabled": bool} {all zero or empty}
  Handshake Create(data type=w18) -> (reference out=w19)
  Handshake Create(data type=T22 {all zero or empty}) -> (reference out=w20)
  Property Node(instance in="802.11 PHY-SAP.gtype" {all zero or empty}, "PSDU (RX)"=w10, "PSDU (TX)"=w11, "CCA detection"=w12, "PhyRxStart.req"=w13, "PhyRxEnd.ind"=w14, "channel state indication"=w15, "PhyTxStart.req"=w16, "PhyTxEnd.ind"=w17, "PHY RX AGC state indication"=w19, "PHY RX Gain change indication"=w20) -> (instance out=w21)
  clock-driven loop (clock = "802.11 AFW Resources.grsc\\MAC") forever {
    call "802.11 PHY-SAP Read MAC.gcdl"(PHY-SAP=w21) -> (CCA detection=w22, PSDU=w23, PSDU valid=w24, PhyRxStart.req=w25, PhyTxEnd.ind=w26, PhyRxEnd.ind=w27, PHY RX AGC state indication=w28, PHY RX Gain change indication=w29)
    Property Node(instance in=w9) -> ("shared properties"=w30, "global timestamp"=w31, "channel state indication"=w32)
    Register Read(reference in=w31) -> (data=w33)
    Property Node(instance in=w25) -> ("valid"=w34)
    Feedback Node(enable?=w34, initial value=u8[6] default, input=w35) -> w36
    call "802.11 MAC RX.gcdl"(PSDU=w23, input valid=w24, PHY RX start indication=w25, PHY RX end indication=w27, PHY CCA timing indication=w22, reset MAC RX statistics=$"reset MAC RX statistics", device MAC address=w36, MPDU filter config=$"MPDU filter config", global timestamp=w33) -> (MAC RX statistics=w37, channel state indication=w38, ICP SDU=w39, output valid=w40, MPDU generation request=w41)
    call "802.11 RX Data Sink.gcdl"(ICP SDU=w39, input valid=w40, FIFO reference="802.11 AFW Resources.grsc\\T2H RX Data") -> (FIFO overflow count=w42)
    $"T2H RX Data overflow" <- w42
    # w43: channel state indication
    Register Write(data=w38, reference in=w32) -> (reference out=w43)
    # w33: global time reference
    Register Read(reference in=w43) -> (data=w44)
    Register Read(reference in=w30) -> (data=w45)
    Property Node(instance in=w45) -> ("format"=w46, "device MAC address"=w35)
    # w41: MPDU request
    Feedback Node(input=w47) -> w48
    call "802.11 Prepare ACK.gcdl"(format=w46, bandwidth=$"ACK bandwidth", MPDU generation request=w41, MAC ready=w48, suppress=$"suppress ACK") -> (MPDU block=w49, output valid=w50, TX after SIFS request=w51)
    Feedback Node(input=w52) -> w53
    call "802.11 TX Data Source.gcdl"(ready for output=w53, H2T TX Data="802.11 AFW Resources.grsc\\H2T TX Data", bypass MAC TX=$"bypass MAC TX") -> (ICP data=w54, output valid=w55, elements available=w56)
    Feedback Node(input=w57) -> w58
    Feedback Node(input=w59) -> w60
    call "802.11 Prepare MPDU.gcdl"(ICP=w54, input valid=w55, elements available=w56, MAC ready for input=w58, TX status indication=w60, backoff value=$"backoff value") -> (MPDU block=w61, ready for input=w52, output valid=w62, TX after backoff request=w63)
    Logical Or(w49, w61) -> w64
    Logical Or(w50, w62) -> w65
    Feedback Node(input=w66) -> w67
    call "802.11 MAC TX.gcdl"(TX after backoff request=w63, TX after SIFS request=w51, channel state indication=w44, global clock value=w33, RX TX turnaround time in global clock ticks=$"RX TX turnaround time", PSDU data ready for input=w67, PHY TX end indication=w26, MPDU block=w64, input valid=w65, reset MAC TX statistics=$"reset MAC TX statistics") -> (MPDU=w68, output valid=w69, PHY TX start request=w70, TX after SIFS data ready for input=w47, TX after backoff data ready for input=w57, TX status indication=w59, MAC TX statistics=w71)
    call "802.11 TX MAC Bypass.gcdl"(ready for output=w67, TX data FIFO reference="802.11 AFW Resources.grsc\\H2T TX Data", bypass MAC TX=$"bypass MAC TX", manual PhyTxStart.req=$"manual PhyTxStart.req", MPDU=w68, input valid=w69, request in=w70) -> (PSDU=w72, output valid=w73, request out=w74)
    call "802.11 PHY-SAP Write MAC.gcdl"(PHY-SAP=w21, PhyTxStart.req=w74, PSDU=w72, PSDU valid=w73, channel state indication=w38) -> (PSDU TX ready for input=w66)
    $"MAC RX statistics" <- w37
    call "802.11 Write RX Events.gcdl"(global timestamp=w33, PHY RX start indication=w25, PHY RX end indication=w27, MAC channel state indication=w38, PHY CCA timing indication=w22, T2H FIFO reference="802.11 AFW Resources.grsc\\T2H Events", PHY RX Gain change indication=w29, PHY RX AGC state indication=w28)
    $"MAC TX statistics" <- w71
    call "802.11 Capture PHY TX Indications.gcdl"(PHY TX end indication in=w26, PHY TX start request in=w74) -> (PHY TX start request out=w75, PHY TX end indication out=w76)
    $"PhyTxStart.req" <- w75
    $"PhyTxEnd.ind" <- w76
    call "802.11 Write TX Events.gcdl"(global time reference=w33, PHY TX end indication=w26, PHY TX start request=w74, TX status indication=w59, T2H FIFO reference="802.11 AFW Resources.grsc\\T2H Events")
  }
  FIFO Create(data type=CFXP(3.13) 0+0i, depth=17) -> (reference out=w77)
  FIFO Create(data type=CFXP(3.13) 0+0i, depth=1025) -> (reference out=w78)
  FIFO Create(data type=CFXP(3.13) 0+0i, depth=1025) -> (reference out=w79)
  FIFO Create(data type=UFXP(5.1) 0, depth=17) -> (reference out=w80)
  Property Node(instance in=T23 {all zero or empty}, "RF to RX FIFO"=w77, "internal loopback FIFO"=w78, "TX to RF FIFO"=w79, "Gain Settings FIFO"=w80) -> (instance out=w81)
  clock-driven loop (clock = "802.11 AFW Resources.grsc\\PHY") forever {
    Property Node(instance in=w9) -> ("global timestamp"=w82, "shared properties"=w83, "TX active"=w84, "OFDM symbol pulse"=w85)
    Register Read(reference in=w82) -> (data=w86)
    Property Node(instance in=w81) -> ("RF to RX FIFO"=w87, "internal loopback FIFO"=w88, "TX to RF FIFO"=w89, "Gain Settings FIFO"=w90)
    Register Read(reference in=w85) -> (data=w91, reference out=w92)
    Register Read(reference in=w83) -> (data=w93)
    # w91: Symbol trigger
    Property Node(instance in=w93) -> ("supported bandwidths"=w94, "DC centered signal"=w95, "channel selector"=w96)
    Feedback Node(input=w97) -> w98
    call "802.11 PHY-SAP Read PHY.gcdl"(PHY-SAP=w21, ready for output=w98) -> (PSDU=w99, PSDU valid=w100, PhyTxStart.req=w101)
    call "niInstr Basic Elements v1 FPGA.lvlib__Detect Rising Edge.gcdl"(signal=w91) -> (edge detected=w102)
    call "802.11 PHY TX Request Handler.gcdl"(symbol trigger in=w102, PhyTxStart.req=w101, supported bandwidths=w94) -> (symbol index=w103, symbol trigger out=w104, start of packet=w105, TX vector out=w106, PhyTxEnd.ind=w107, TX active=w108)
    Register Write(data=w108, reference in=w84) -> (reference out=w109)
    call "802.11 RX Data Source.gcdl"(RX data source=$"RX data source", mute RX while TX active?=$"mute RX while TX active?", TX active register=w109, RF to RX FIFO=w87, internal loopback FIFO=w88, OFDM symbol trigger register=w92, produce silent samples=$"produce silent samples", H2T FIFO="802.11 AFW Resources.grsc\\H2T RX Baseband") -> (sample=w110, output valid=w111)
    call "802.11 Signal Filter.gcdl"(sample in=w110, input valid=w111, configuration=w93) -> (20MHz sample out=w112, output valid=w113, 40MHz sample out=w114, 80MHz sample out=w115)
    Feedback Node(input=w116) -> w117
    call "802.11 Synchronization.gcdl"(bypass synchronization=$"bypass synchronization", rearm packet start generator=$"rearm packet start generator", packet start sample index=$"packet start sample index", synchronization settings=$"synchronization settings", rearm sychronization=w117, sample in=w110, input valid=w111, filtered sample=w112, filtered sample valid=w113) -> (sample out=w118, output valid=w119, packet start=w120, compensated CFO=w121, CCA signal detected=w122)
    w123 = T18 {"format"="a", "channel selector"=0, "device MAC address"=[0, 0, 0, 0, 0, 0], "DC centered signal"=FALSE, "supported bandwidths"={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}}
    Feedback Node(enable?=w120, initial value=w123, input=w93) -> w124
    Property Node(instance in=w124) -> ("format"=w125, instance out=w126)
    Feedback Node(input=w127) -> w128
    call "802.11 RX IQ Processing.gcdl"(sample=w118, input valid=w119, packet start=w120, configuration=w128) -> (subcarrier=w129, subcarrier timing=w130, subcarrier field map=w131, last sample received=w132, channel estimate=w133, channel estimate timing=w134)
    Feedback Node(input=w135) -> w136
    call "802.11 RX Bit Processing.gcdl"(subcarrier timing=w130, subcarrier=w129, field map=w131, configuration=w136, noise coefficient=$"noise coefficient") -> (current OFDM symbol=w137, PSDU=w138, bit=w139, bit valid=w140, last byte decoded=w141, PSDU valid=w142)
    call "802.11 RX PHY State Machine.gcdl"(bit=w139, bit valid=w140, shared properties=w126, current OFDM symbol=w137, last bit of packet decoded=w141, last sample of packet received=w132, global timestamp=w86) -> (RX bit processing configuration=w135, RX IQ processing configuration=w127, PhyRxStart.ind=w143, PhyRxEnd.ind=w144)
    Property Node(instance in=w144) -> ("valid"=w116)
    Feedback Node(input=w145) -> w146
    To Fixed Point(number=w146) -> w147: FXP(10.3) Saturate:ConvergentRounding
    Select(s=$"enable AGC", t=w147, f=$"RF gain") -> w148
    call "802.11 Power Measurement.gcdl"(sample=w115, input valid=w113, CCA energy detect threshold=$"CCA energy detect threshold", power calibration offset=$"power calibration offset", RF gain=w148, sample 20MHz filtered=w112, sample 40MHz filtered=w114) -> (signal power=w149, output valid=w150, out of range?=w151, CCA energy detect=w152, RF input power=w153)
    Property Node(instance in=T20 {all zero or empty}, "CCA energy detection busy"=w152, "CCA signal detection busy"=w122) -> (instance out=w154)
    call "802.11 AGC.gcdl"(signal power=w149, packet start=w120, rearm AGC=w117, AGC thresholds=$"AGC tresholds", AGC timeout=$"AGC timeout", signal power valid=w150, enable AGC=$"enable AGC") -> (gain=w155, trigger gain setting=w156, state=w157, last applied gain=w145)
    Property Node(instance in=T22 {all zero or empty}, "trigger gain setting"=w156, "gain"=w155) -> (instance out=w158)
    w159 = cluster{"AGC state": T21, "AGC enabled": bool} {all zero or empty}
    Property Node(instance in=w159, "AGC state"=w157, "AGC enabled"=$"enable AGC") -> (instance out=w160)
    call "802.11 PHY-SAP Write PHY.gcdl"(PHY-SAP=w21, PSDU valid=w142, PSDU=w138, CCA detection=w154, PhyRxEnd.ind=w144, PhyRxStart.ind=w143, PhyTxEnd.ind=w107, PHY RX Gain change indication=w158, PHY RX AGC state indication=w160)
    call "802.11 Prepare RX IQ Data for T2H.gcdl"(subcarrier=w129, timing=w130, field map=w131, FIFO reference="802.11 AFW Resources.grsc\\T2H Constellation") -> (FIFO overflow count=w161)
    $"T2H Constallation overflow" <- w161
    call "802.11 Prepare Channel Estimation for T2H.gcdl"(channel estimate=w133, timing=w134, format=w125, FIFO reference="802.11 AFW Resources.grsc\\T2H Channel Estimation") -> (FIFO overflow count=w162)
    $"T2H Channel Estimation overflow" <- w162
    call "802.11 Trigger Capture RX Samples.gcdl"(trigger condition=$"trigger condition", manual trigger=$"manual trigger", RX packet start=w120, TX active register=w109, CCA energy detected=w152) -> (trigger=w163)
    call "802.11 Capture RX Samples.gcdl"(sample=w118, input valid=w119, trigger=w163, number of samples to capture=$"number of samples to capture", FIFO reference="802.11 AFW Resources.grsc\\T2H RX Power Spectrum", number of samples before trigger=$"number of samples before trigger") -> (FIFO overflow count=w164)
    $"T2H RX Power Spectrum overflow" <- w164
    call "802.11 TX Bit Processing.gcdl"(symbol trigger=w104, OFDM symbol index=w103, TX vector=w106, PSDU=w99, input valid=w100) -> (bit=w165, output valid=w166, ready for input=w97, modulation=w167)
    call "802.11 TX IQ Processing.gcdl"(symbol trigger=w104, OFDM symbol index=w103, TX vector=w106, channel selector=w96, start of packet=w105, bit valid=w166, bit=w165, bit processing modulation=w167, DC centered signal=w95, supported bandwidths=w94) -> (data out=w168, output valid=w169)
    call "802.11 TX Data Sink.gcdl"(TX to RF FIFO=w89, internal loopback FIFO=w88, sample=w168, input valid=w169, T2H FIFO="802.11 AFW Resources.grsc\\T2H TX Baseband") -> (T2H FIFO overflow count=w170, TX to RF FIFO overflow count=w171, internal loopback FIFO overflow count=w172)
    $"T2H TX Baseband FIFO overflow" <- w170
    $"TX to RF FIFO overflow" <- w171
    $"compensated CFO" <- w121
    $"internal loopback FIFO overflow" <- w172
    call "802.11 RX Bit Processing Data Sink.gcdl"(PSDU=w138, input valid=w142, FIFO reference="802.11 AFW Resources.grsc\\T2H RX Bit Processing Output") -> (FIFO overflow count=w173)
    $"T2H RX Bit Processing Output FIFO overflow" <- w173
    call "802.11 TX Bit Processing Data Sink.gcdl"(bit=w165, input valid=w166, modulation=w167, FIFO reference="802.11 AFW Resources.grsc\\T2H TX Bit Processing Output") -> (FIFO overflow count=w174)
    $"T2H TX Bit Processing Output FIFO overflow" <- w174
    call "802.11 Capture PHY RX Indications.gcdl"(PHY RX start indication in=w143, PHY RX end indication in=w144) -> (PHY RX start indication out=w175, PHY RX end indication out=w176)
    $"PhyRxStart.ind" <- w175
    $"PhyRxEnd.ind" <- w176
    $"RF input power" <- w153
    Feedback Node(enable?=w120, input=w153) -> w177
    $"RF input power at packet start" <- w177
    $"signal power" <- w149
    Feedback Node(enable?=w120, input=w149) -> w178
    $"signal power at packet start" <- w178
    $"out of range?" <- w151
    FIFO Write(Control Protocol Input=w156, data=w155, reference in=w90)
    $"last applied gain" <- w145
  }
  call "Create Resources.gvi"() -> (config.resources=w179, sync.resources=w180, time.resources=w181)
  clock-driven loop (clock = "40 MHz Onboard Clock") {
    Io Write(data=$"RF 1/Rx/Enable", reference in="RF 1/Rx/Enable")
    Io Write(data=$"RF 0/Tx/Enable", reference in="RF 0/Tx/Enable")
    Io Write(data=$"RF 0/Rx/Enable", reference in="RF 0/Rx/Enable")
    Feedback Node(input=w182) -> w183
    Property Node(instance in=w81) -> ("Gain Settings FIFO"=w184)
    FIFO Read(Control Protocol Input=TRUE, reference in=w184) -> (Control Protocol Output=w182, data=w185)
    Feedback Node(enable?=w182, input=w185) -> w186
    To Fixed Point(number=w186) -> w187: UFXP(6.1) Wrap:Truncate
    # Register Bus and Required Controls/Indicators
    Scale By Power Of 2(n=1, x=w187) -> w188
    To Unsigned Byte Integer(number=w188) -> w189
    Property Node(instance in=T2 {"power enable"=TRUE, "mixer enable"=TRUE, "gain"=0}, "power enable"=$"power enable", "mixer enable"=$"mixer enable", "gain"=w189) -> (instance out=w190)
    call "Set Gain.gcdl"(ATR State=$"ATR State", Radio Control Destination=$"Radio Control Destination", FPGA.Fifo="802.11 AFW Resources.grsc\\AGC Reg Bus 0 Access FIFO", daughterboard=$daughterboard, antenna configuration=$"antenna configuration", Write ATR?=w183, lo lpf enable=$"lo lpf enable", rx.configuration=w190, tx.configuration=$"tx.configuration", spi address=$"spi address", cpld enable=$"cpld enable")
    Io Write(data=$"RF 1/Tx/Enable", reference in="RF 1/Tx/Enable")
    Feedback Node(input=w191) -> w192
    Property Node(instance in=w192) -> ("ready for port 0 input"=w193, "ready for port 1 input"=w194)
    Feedback Node(input=w195) -> w196
    call "niInstr Register Bus v1 FPGA.lvlib__Process.gcdl"(reg.notify host.go rcvd=$"reg.notify host.go rcvd 0", reg.host read.go rcvd=$"reg.host read.go rcvd 0", read completion=w196, reg.reset=$"reg.reset 0", reg.host instruction fifo="niInstr Register Bus v0.grsc\\reg.host instruction fifo 0", ready for output=w194) -> (reg.notify host.go=w197, reg.host read.data=w198, register instruction=w199)
    $"reg.notify host.go 0" <- w197
    $"reg.host read.data 0" <- w198
    FIFO Read(Control Protocol Input=w193, reference in="802.11 AFW Resources.grsc\\AGC Reg Bus 0 Access FIFO") -> (Control Protocol Output=w200, data=w201)
    call "Retrieve FPGA Scoped Instruction.gcdl"(number=w201, valid=w200) -> (output cluster=w202)
    Feedback Node(input=w203) -> w204
    call "niInstr Register Bus v1 FPGA.lvlib__Register Instruction Arbiter (2 inputs).gcdl"(port 0=w202, port 1=w199, reset=FALSE, ready for output=w204) -> (register instr out=w205, ready for input=w191)
    call "Registers.gcdl"(register instruction=w205, config.resources=w179, sync.resources=w180, time.resources=w181) -> (read completion out=w195, ready for input=w203)
    stop if FALSE
  }
  clock-driven loop (clock = "Data Clock") forever {
    # Baseband to/from RF conversion
    # Data Reception from Antenna, downconversion to baseband sample rate, received data will be written into RX baseband input FIFO
    # Reading of TX baseband FIFO, upconversion and transmission to antenna
    Property Node(instance in=w9) -> ("shared properties"=w206, "global timestamp"=w207, "OFDM symbol pulse"=w208)
    call "Mod N Indexer U16 v2.gcdl"(N=$"Data clock cycles per tick (0.1us)", enable=$"data clock locked?") -> (wrap back?=w209)
    call "niInstr Basic Elements v1 FPGA.lvlib__Count Up U32.gcdl"(increment=w209, reset=FALSE) -> (count out=w210)
    Register Write(data=w210, reference in=w207)
    call "Mod N Indexer U16 v2.gcdl"(N=$"Data clock cycles per OFDM symbol", enable=$"data clock locked?") -> (wrap back?=w211)
    Register Write(data=w211, reference in=w208)
    w212 = T17 {"5 MHz"=FALSE, "10 MHz"=FALSE, "20 MHz"=TRUE, "40 MHz"=TRUE, "80 Mhz"=FALSE, "160 MHz"=FALSE}
    w213 = T18 {"format"="a", "channel selector"=0, "device MAC address"=[0, 0, 0, 0, 0, 0], "DC centered signal"=FALSE, "supported bandwidths"={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}}
    Property Node(instance in=w213, "format"=$format, "channel selector"=$"channel selector", "device MAC address"=$"device MAC address", "DC centered signal"=$"DC centered signal", "supported bandwidths"=w212) -> (instance out=w214)
    Register Write(data=w214, reference in=w206)
    $Timestamp <- w210
    Property Node(instance in=w81) -> ("TX to RF FIFO"=w215, "RF to RX FIFO"=w216)
    Build Array($"rx 0.stream enable", $"rx 1.stream enable") -> w217
    w218 = T24 {"0x800000000000", 0, 0, "0x1FFFF", "0x1FFFF", 0, 0, 0, 0, 0, 0, 0}
    Property Node(instance in=w218, "impairments"=$"rx 0.impairments", "frequency shift"=$"rx 0.frequency shift", "phase"=$"rx 0.phase", "output sample rate"=$"rx.output sample rate", "delay"=$"rx.delay") -> (instance out=w219)
    w220 = T24 {"0x800000000000", 0, 0, "0x1FFFF", "0x1FFFF", 0, 0, 0, 0, 0, 0, 0}
    Property Node(instance in=w220, "delay"=$"rx.delay", "output sample rate"=$"rx.output sample rate", "impairments"=$"rx 1.impairments", "frequency shift"=$"rx 1.frequency shift", "phase"=$"rx 1.phase") -> (instance out=w221)
    Build Array(w219, w221) -> w222
    call "802.11 USRP Stream RX.gcdl"(RF to RX FIFO reference=w216, enable DC offset correction=$"enable DC offset correction", rx.reset=$"rx.reset", rx.rf channel=$"rx.rf channel", rx. stream enabled=w217, rx.abort=$"rx.abort", DDC parameters=w222) -> (rx.number of IQ data overflows=w223, rx.dsp reset done=w224, DC average=w225, rx.state=w226, rx.samples processed=w227, rx.number of overflows=w228)
    $"rx.number of IQ data overflows" <- w223
    Build Array($"tx 0.stream enable", $"tx 1.stream enable") -> w229
    w230 = T25 {0, "0x1FFFF", "0x1FFFF", 0, 0, 0, 0, 0, 0, 0, 0, "0x200000", "0x200000", 0}
    Property Node(instance in=w230, "gain"=$"tx 0.gain", "frequency shift"=$"tx 0.frequency shift", "phase"=$"tx 0.phase", "impairments"=$"tx 0.impairments", "input sample rate"=$"tx.input sample rate", "delay"=$"tx.delay") -> (instance out=w231)
    w232 = T25 {0, "0x1FFFF", "0x1FFFF", 0, 0, 0, 0, 0, 0, 0, 0, "0x200000", "0x200000", 0}
    Property Node(instance in=w232, "delay"=$"tx.delay", "input sample rate"=$"tx.input sample rate", "gain"=$"tx 1.gain", "frequency shift"=$"tx 1.frequency shift", "phase"=$"tx 1.phase", "impairments"=$"tx 1.impairments") -> (instance out=w233)
    Build Array(w231, w233) -> w234
    call "802.11 USRP Stream TX.gcdl"(tx.enable streams=w229, tx.reset=$"tx.reset", tx.rf channel=$"tx.rf channel", TX to RF FIFO reference=w215, tx.abort=$"tx.abort", DUC parameters=w234) -> (tx.state=w235, tx.samples processed=w236, tx.underflows=w237, tx.number of IQ data overflows=w238, tx.dsp reset done=w239)
    $"tx.state" <- w235
    $"rx.dsp reset done" <- w224
    $"tx.samples processed" <- w236
    $"rx.state" <- w226
    $"tx.underflows" <- w237
    $"rx.samples processed" <- w227
    $"tx.number of IQ data overflows" <- w238
    $"rx.number of overflows" <- w228
    $"tx.dsp reset done" <- w239
    $"DC average" <- w225
  }
  call "LEDs.gvi"()
  call "niUsrpRio Config v1 FPGA.lvlib__Process.gvi"(resources=w179)
